# Grasshopper definition KNNobject.gh (Grasshopper 1.0.7)
# plug-ins: Kangaroo2 Components, Human

# ---- group: logic 1
panel = Panel("C:\Users\KarlRoesch\Desktop\karldesktopfolder\bracket\trainform\mainpart\BR-47472.3dm")
_3dm = Import3DM(File=panel, Layer="*", Name="*")
bbox = BoundingBox(Content=_3dm, Plane=PlaneXY(0, 0, 0), UnionBox=True)  # -> Box, Box_2
debrep = DeconstructBrep(Brep=bbox.Box_2)  # -> Faces, Edges, Vertices
item = ListItem(List=debrep.Faces, Index=0, Wrap=True)
xy = XYPlane(Origin=Point(0, 0, 0))
orient = Orient(Geometry=_3dm, Source=item, Target=xy)  # -> Geometry, Transform
triremesh = TriRemesh(Geometry=orient.Geometry, Length=Slider(1, range=0..10), Iterations=25)  # -> Triangulation, Dual, Creases
preview = CustomPreview(Geometry=triremesh.Dual, Material=ColourSwatch(SwatchColor=RGB(54, 238, 245)))

# ---- group: logic 2
pt = ConstructPoint(XCoordinate=0, YCoordinate=0, ZCoordinate=0)
Y = UnitY(Factor=1)
Z = UnitZ(Factor=1)
X = UnitX(Factor=1)
contour = Contour(Shape=triremesh.Triangulation, Point=pt, Direction=Y, Distance="1")  # -> flatten(Contours)
contour_2 = Contour(Shape=triremesh.Triangulation, Point=pt, Direction=Z, Distance="1")  # -> flatten(Contours)
contour_3 = Contour(Shape=triremesh.Triangulation, Point=pt, Direction=X, Distance="1")  # -> flatten(Contours)
mcx = MultipleCurves(Curves=[contour_3, contour, contour_2])  # -> Points, IndexA, IndexB, ParamA, ParamB
panel_2 = Panel("""0
1
2""")
sift = SiftPattern(List=mcx.Points, SiftPattern=panel_2)  # -> Output0, Output1, Output2
clean = CleanTree(RemoveNulls=True, RemoveInvalid=True, RemoveEmpty=False, Tree=sift.Output0)
clean_2 = CleanTree(RemoveNulls=True, RemoveInvalid=True, RemoveEmpty=False, Tree=sift.Output1)
clean_3 = CleanTree(RemoveNulls=True, RemoveInvalid=True, RemoveEmpty=False, Tree=sift.Output2)
pdecon = Deconstruct(Point=clean)  # -> XComponent, YComponent, ZComponent
pdecon_2 = Deconstruct(Point=clean_3)  # -> XComponent, YComponent, ZComponent
pdecon_3 = Deconstruct(Point=clean_2)  # -> XComponent, YComponent, ZComponent
pt_2 = ConstructPoint(XCoordinate=pdecon.XComponent, YCoordinate=pdecon.YComponent, ZCoordinate=pdecon.ZComponent)
pt_3 = ConstructPoint(XCoordinate=pdecon_2.XComponent, YCoordinate=pdecon_2.YComponent, ZCoordinate=pdecon_2.ZComponent)
pt_4 = ConstructPoint(XCoordinate=pdecon_3.XComponent, YCoordinate=pdecon_3.YComponent, ZCoordinate=pdecon_3.ZComponent)
centroid = Centroid(PointA=pt_2, PointB=pt_4, PointC=pt_3)  # -> Centroid, MedianAB, MedianBC, MedianCA
clean_4 = CleanTree(RemoveNulls=True, RemoveInvalid=True, RemoveEmpty=False, Tree=centroid.Centroid)
cp = ClosestPoint(Point=clean_4, Cloud=mcx.Points)  # -> ClosestPoint, CPIndex, Distance
vec2pt = Vector2Pt(PointA=cp.ClosestPoint, PointB=centroid.Centroid, Unitize=False)  # -> Vector, Length

# ---- group: logic 4
panel_3 = Panel("IsCone")
panel_4 = Panel("IsDowel")
panel_5 = Panel("IsPlane")
panel_6 = Panel("IsFillet")
panel_7 = Panel("IsTenon")
panel_8 = Panel("IsBlade")
panel_9 = Panel("IsBar")
panel_10 = Panel("IsStrut")
panel_11 = Panel("IsRidge")
panel_12 = Panel("IsMortise")
panel_13 = Panel("IsHole")
panel_14 = Panel("IsFlange")
panel_15 = Panel("0")
panel_16 = Panel("0")
panel_17 = Panel("0")
panel_18 = Panel("0")
panel_19 = Panel("0")
panel_20 = Panel("0")
panel_21 = Panel("0")
panel_22 = Panel("0")
panel_23 = Panel("0")
panel_24 = Panel("0")
panel_25 = Panel("0")
panel_26 = Panel("0")

# ---- group: logic 3
X_2 = UnitX(Factor=1)
Y_2 = UnitY(Factor=1)
Z_2 = UnitZ(Factor=1)
angle = Angle(VectorA=X_2, VectorB=vec2pt.Vector)  # -> Angle, Reflex
angle_2 = Angle(VectorA=Y_2, VectorB=vec2pt.Vector)  # -> Angle, Reflex
angle_3 = Angle(VectorA=Z_2, VectorB=vec2pt.Vector)  # -> Angle, Reflex
vlen = VectorLength(Vector=vec2pt.Vector)
deg = Degrees(Radians=angle.Angle)
deg_2 = Degrees(Radians=angle_2.Angle)
deg_3 = Degrees(Radians=angle_3.Reflex)
clean_5 = CleanTree(RemoveNulls=True, RemoveInvalid=True, RemoveEmpty=False, Tree=deg_2)
clean_6 = CleanTree(RemoveNulls=True, RemoveInvalid=True, RemoveEmpty=False, Tree=vlen)
clean_7 = CleanTree(RemoveNulls=True, RemoveInvalid=True, RemoveEmpty=False, Tree=deg)
clean_8 = CleanTree(RemoveNulls=True, RemoveInvalid=True, RemoveEmpty=False, Tree=deg_3)
int = Integer(clean_6)
int_2 = Integer(clean_7)
int_3 = Integer(clean_5)
int_4 = Integer(clean_8)
concat = Concatenate(
    FragmentA=int,
    FragmentB=",",
    FragmentC=int_2,
    FragmentD=",",
    FragmentE=int_3,
    FragmentF=",",
    FragmentG=int_4,
    FragmentH=",",
    FragmentI=panel_16,
    FragmentJ=",",
    FragmentK=panel_15,
    FragmentL=",",
    FragmentM=panel_19,
    FragmentN=",",
    FragmentO=panel_20,
    FragmentP=",",
    FragmentQ=panel_24,
    FragmentR=",",
    FragmentS=panel_25,
    FragmentT=",",
    FragmentU=panel_23,
    FragmentV=",",
    FragmentW=panel_26,
    FragmentX=",",
    FragmentY=panel_21,
    FragmentZ=",",
    FragmentAA=panel_22,
    FragmentAB=",",
    FragmentAC=panel_18,
    FragmentAD=",",
    FragmentAE=panel_17)

# ---- group: logic 5
concat_2 = Concatenate(
    FragmentA="Vlen",
    FragmentB=",",
    FragmentC="VdegX",
    FragmentD=",",
    FragmentE="VdegY",
    FragmentF=",",
    FragmentG="VdegZ",
    FragmentH=",",
    FragmentI="IsHole",
    FragmentJ=",",
    FragmentK="IsFlange",
    FragmentL=",",
    FragmentM="IsRidge",
    FragmentN=",",
    FragmentO="IsMortise",
    FragmentP=",",
    FragmentQ="IsTenon",
    FragmentR=",",
    FragmentS="IsPlane",
    FragmentT=",",
    FragmentU="IsFillet",
    FragmentV=",",
    FragmentW="IsStrut",
    FragmentX=",",
    FragmentY="IsCone",
    FragmentZ=",",
    FragmentAA="IsBlade",
    FragmentAB=",",
    FragmentAC="IsDowel",
    FragmentAD=",",
    FragmentAE="IsBar")
panel_39 = Panel("C:\Users\KarlRoesch\Desktop\karldesktopfolder\bracket\trainform\bar\bar.csv")
panel_40 = Panel("C:\Users\KarlRoesch\Desktop\karldesktopfolder\bracket\trainform\hole\hole.csv")
panel_41 = Panel("C:\Users\KarlRoesch\Desktop\karldesktopfolder\bracket\trainform\ridge\ridge.csv")
panel_42 = Panel("C:\Users\KarlRoesch\Desktop\karldesktopfolder\bracket\trainform\flange\flange.csv")
panel_43 = Panel("C:\Users\KarlRoesch\Desktop\karldesktopfolder\bracket\trainform\dowel\dowel.csv")
panel_44 = Panel("C:\Users\KarlRoesch\Desktop\karldesktopfolder\bracket\trainform\mortise\mortise.csv")
panel_45 = Panel("C:\Users\KarlRoesch\Desktop\karldesktopfolder\bracket\trainform\plane\plane.csv")
panel_46 = Panel("C:\Users\KarlRoesch\Desktop\karldesktopfolder\bracket\trainform\strut\strut.csv")
panel_47 = Panel("C:\Users\KarlRoesch\Desktop\karldesktopfolder\bracket\trainform\blade\blade.csv")
panel_48 = Panel("C:\Users\KarlRoesch\Desktop\karldesktopfolder\bracket\trainform\fillet\fillet.csv")
panel_49 = Panel("C:\Users\KarlRoesch\Desktop\karldesktopfolder\bracket\trainform\tenon\tenon.csv")
panel_50 = Panel("C:\Users\KarlRoesch\Desktop\karldesktopfolder\bracket\trainform\cone\cone.csv")
file = ReadFile(File=panel_39, PerLineParse=True)
file_2 = ReadFile(File=panel_40, PerLineParse=True)
file_3 = ReadFile(File=panel_41, PerLineParse=True)
file_4 = ReadFile(File=panel_43, PerLineParse=True)
file_5 = ReadFile(File=panel_42, PerLineParse=True)
file_6 = ReadFile(File=panel_44, PerLineParse=True)
file_7 = ReadFile(File=panel_46, PerLineParse=True)
file_8 = ReadFile(File=panel_45, PerLineParse=True)
file_9 = ReadFile(File=panel_47, PerLineParse=True)
file_10 = ReadFile(File=panel_48, PerLineParse=True)
file_11 = ReadFile(File=panel_50, PerLineParse=True)
file_12 = ReadFile(File=panel_49, PerLineParse=True)
split = SplitList(List=file, Index=1)  # -> ListA, ListB
split_2 = SplitList(List=file_2, Index=1)  # -> ListA, ListB
split_3 = SplitList(List=file_3, Index=1)  # -> ListA, ListB
split_4 = SplitList(List=file_4, Index=1)  # -> ListA, ListB
split_5 = SplitList(List=file_5, Index=1)  # -> ListA, ListB
split_6 = SplitList(List=file_6, Index=1)  # -> ListA, ListB
split_7 = SplitList(List=file_7, Index=1)  # -> ListA, ListB
split_8 = SplitList(List=file_8, Index=1)  # -> ListA, ListB
split_9 = SplitList(List=file_9, Index=1)  # -> ListA, ListB
split_10 = SplitList(List=file_10, Index=1)  # -> ListA, ListB
split_11 = SplitList(List=file_11, Index=1)  # -> ListA, ListB
split_12 = SplitList(List=file_12, Index=1)  # -> ListA, ListB
merge = Merge(
    Data1=concat_2,
    Data2=concat,
    Data3=split_2.ListB,
    Data4=split_5.ListB,
    Data5=split_3.ListB,
    Data6=split_6.ListB,
    Data7=split_12.ListB,
    Data8=split_8.ListB,
    Data9=split_10.ListB,
    Data10=split_7.ListB,
    Data11=split_11.ListB,
    Data12=split_9.ListB,
    Data13=split_4.ListB,
    Data14=split.ListB)  # -> flatten(Result)

# ---- group: logic 6
panel_51 = Panel(merge)
split_13 = TextSplit(Text=panel, Separators="\")
item_2 = ListItem(List=split_13, Index=8, Wrap=True)
panel_52 = Panel("C:\Users\KarlRoesch\Desktop\karldesktopfolder\bracket\trainform\mainpart\")
rep = ReplaceText(Text=item_2, Find=".", RecursiveReplace=False)
panel_53 = Panel(rep)
concat_3 = Concatenate(FragmentA=panel_53, FragmentB=".csv")
concat_4 = Concatenate(FragmentA=panel_52, FragmentB=concat_3)
path = FilePath(concat_4)
c_script = CSharpScript(save=Button(), path=path, data=panel_51)  # inputs save: Boolean, path: String, data: list of String
# ---------- c_script: C# ----------
    if(save){
      var fileinfo = new System.IO.FileInfo(path);
      if(!fileinfo.Directory.Exists){
        fileinfo.Directory.Create();
      }
      
      var sw = fileinfo.CreateText();
      for(int i = 0; i < data.Count; i++){
        string row = data[i];
        if(i < data.Count - 1){
          sw.WriteLine(row);
        }else{
          sw.Write(row);
        }
      }
      
      sw.Flush();
      sw.Close();
    }
# ---------- end c_script ----------

# ---- group: logic 7
panel_66 = Panel("C:\Users\KarlRoesch\Desktop\karldesktopfolder\bracket\trainform\hole\BR-474723dmhole.txt")
panel_67 = Panel("C:\Users\KarlRoesch\Desktop\karldesktopfolder\bracket\trainform\flange\BR-474723dmflange.txt")
panel_68 = Panel("C:\Users\KarlRoesch\Desktop\karldesktopfolder\bracket\trainform\plane\BR-474723dmplane.txt")
panel_69 = Panel("C:\Users\KarlRoesch\Desktop\karldesktopfolder\bracket\trainform\ridge\BR-474723dmridge.txt")
panel_70 = Panel("C:\Users\KarlRoesch\Desktop\karldesktopfolder\bracket\trainform\fillet\BR-474723dmfillet.txt")
panel_71 = Panel("C:\Users\KarlRoesch\Desktop\karldesktopfolder\bracket\trainform\mortise\BR-474723dmmortise.txt")
panel_72 = Panel("C:\Users\KarlRoesch\Desktop\karldesktopfolder\bracket\trainform\tenon\BR-474723dmtenon.txt")
panel_73 = Panel("C:\Users\KarlRoesch\Desktop\karldesktopfolder\bracket\trainform\dowel\BR-474723dmdowel.txt")
panel_74 = Panel("C:\Users\KarlRoesch\Desktop\karldesktopfolder\bracket\trainform\blade\BR-474723dmblade.txt")
panel_75 = Panel("C:\Users\KarlRoesch\Desktop\karldesktopfolder\bracket\trainform\cone\BR-474723dmcone.txt")
panel_76 = Panel("C:\Users\KarlRoesch\Desktop\karldesktopfolder\bracket\trainform\strut\BR-474723dmstrut.txt")
panel_77 = Panel("C:\Users\KarlRoesch\Desktop\karldesktopfolder\bracket\trainform\bar\BR-474723dmbar.txt")
panel_78 = Panel(concat_2)
file_13 = ReadFile(File=panel_66, PerLineParse=True)
file_14 = ReadFile(File=panel_67, PerLineParse=True)
num = Number(file_13)
file_15 = ReadFile(File=panel_69, PerLineParse=True)
file_16 = ReadFile(File=panel_73, PerLineParse=True)
file_17 = ReadFile(File=panel_74, PerLineParse=True)
file_18 = ReadFile(File=panel_68, PerLineParse=True)
file_19 = ReadFile(File=panel_75, PerLineParse=True)
file_20 = ReadFile(File=panel_72, PerLineParse=True)
file_21 = ReadFile(File=panel_70, PerLineParse=True)
file_22 = ReadFile(File=panel_71, PerLineParse=True)
num_2 = Number(file_14)
file_23 = ReadFile(File=panel_77, PerLineParse=True)
expression = Expression(x=num, Expression="Round(x,6)")
file_24 = ReadFile(File=panel_76, PerLineParse=True)
num_3 = Number(file_15)
num_4 = Number(file_16)
num_5 = Number(file_18)
num_6 = Number(file_17)
num_7 = Number(file_20)
num_8 = Number(file_21)
num_9 = Number(file_19)
expression_2 = Expression(x=num_2, Expression="Round(x,6)")
num_10 = Number(file_22)
num_11 = Number(file_23)
num_12 = Number(file_24)
expression_3 = Expression(x=num_3, Expression="Round(x,6)")
expression_4 = Expression(x=num_4, Expression="Round(x,6)")
expression_5 = Expression(x=num_6, Expression="Round(x,6)")
expression_6 = Expression(x=num_5, Expression="Round(x,6)")
expression_7 = Expression(x=num_9, Expression="Round(x,6)")
expression_8 = Expression(x=num_7, Expression="Round(x,6)")
expression_9 = Expression(x=num_8, Expression="Round(x,6)")
expression_10 = Expression(x=num_10, Expression="Round(x,6)")
panel_79 = Panel(expression)
expression_11 = Expression(x=num_11, Expression="Round(x,6)")
expression_12 = Expression(x=num_12, Expression="Round(x,6)")
panel_80 = Panel(expression_2)
pt_5 = ConstructPoint(XCoordinate=panel_79, YCoordinate="1", ZCoordinate=0)
panel_81 = Panel(expression_3)
panel_82 = Panel(expression_4)
panel_83 = Panel(expression_6)
panel_84 = Panel(expression_5)
panel_85 = Panel(expression_8)
panel_86 = Panel(expression_9)
panel_87 = Panel(expression_7)
panel_88 = Panel(expression_10)
pt_6 = ConstructPoint(XCoordinate=panel_80, YCoordinate="1", ZCoordinate=0)
panel_89 = Panel(expression_11)
panel_90 = Panel(expression_12)
pt_7 = ConstructPoint(XCoordinate=panel_81, YCoordinate="1", ZCoordinate=0)
pt_8 = ConstructPoint(XCoordinate=panel_82, YCoordinate="1", ZCoordinate=0)
pt_9 = ConstructPoint(XCoordinate=panel_84, YCoordinate="1", ZCoordinate=0)
pt_10 = ConstructPoint(XCoordinate=panel_83, YCoordinate="1", ZCoordinate=0)
pt_11 = ConstructPoint(XCoordinate=panel_87, YCoordinate="1", ZCoordinate=0)
pt_12 = ConstructPoint(XCoordinate=panel_85, YCoordinate="1", ZCoordinate=0)
pt_13 = ConstructPoint(XCoordinate=panel_86, YCoordinate="1", ZCoordinate=0)
pt_14 = ConstructPoint(XCoordinate=panel_88, YCoordinate="1", ZCoordinate=0)
pt_15 = ConstructPoint(XCoordinate=panel_89, YCoordinate="1", ZCoordinate=0)
pt_16 = ConstructPoint(XCoordinate=panel_90, YCoordinate="1", ZCoordinate=0)
hole_trained_points = Panel("0.984765")
flange_trained_points = Panel("0.985062")
ridge_trained_points = Panel("0.985818")
mortise_trained_points = Panel("0.985575")
tenon_trained_points = Panel("0.984981")
plane_trained_points = Panel("0.985143")
strut_trained_points = Panel("0.985494")
blade_trained_points = Panel("0.985683")
dowel_trained_points = Panel("0.985224")
bar_trained_points = Panel("0.984819")

# ---- group: logic 8
X_3 = UnitX(Factor=1)
neg = Negative(Value=Slider(2, range=0..10))
neg_2 = Negative(Value=Slider(10, range=0..10))
neg_3 = Negative(Value=Slider(4, range=0..10))
neg_4 = Negative(Value=Slider(8, range=0..10))
neg_5 = Negative(Value=Slider(6, range=0..10))
neg_6 = Negative(Value=Slider(12, range=0..12))
neg_7 = Negative(Value=Slider(16, range=0..16))
neg_8 = Negative(Value=Slider(14, range=0..14))
neg_9 = Negative(Value=Slider(18, range=0..18))
neg_10 = Negative(Value=Slider(22, range=0..22))
pt_17 = ConstructPoint(XCoordinate=1, YCoordinate=1, ZCoordinate=0)
pt_18 = ConstructPoint(XCoordinate=0, YCoordinate=0, ZCoordinate=0)
neg_11 = Negative(Value=Slider(20, range=0..20))
rev = Reverse(Vector=X_3)
Y_3 = UnitY(Factor=neg)
Y_4 = UnitY(Factor=neg_2)
Y_5 = UnitY(Factor=neg_3)
Y_6 = UnitY(Factor=neg_4)
Y_7 = UnitY(Factor=neg_5)
Y_8 = UnitY(Factor=neg_6)
Y_9 = UnitY(Factor=neg_7)
Y_10 = UnitY(Factor=neg_8)
Y_11 = UnitY(Factor=neg_9)
Y_12 = UnitY(Factor=neg_10)
Y_13 = UnitY(Factor=neg_11)
pt_19 = ConstructPoint(XCoordinate=0, YCoordinate=0.5, ZCoordinate=0)
pt_20 = ConstructPoint(XCoordinate=1, YCoordinate=0.5, ZCoordinate=0)
ln = Line(StartPoint=pt_19, EndPoint=pt_20)
bzspan = BezierSpan(StartPoint=pt_18, StartTangent=X_3, EndPoint=pt_17, EndTangent=rev)  # -> Curve, Length, Domain
rec_2pt = Rectangle2Pt(Plane=PlaneXY(0, 0, 0), PointA=pt_17, PointB=pt_18, Radius=0)  # -> Rectangle, Length
dash = DashPattern(Curve=ln, Pattern=Slider(0.037, range=0..1))  # -> Dashes, Gaps
move = Move(Geometry=[bzspan.Curve, rec_2pt.Rectangle, dash.Dashes], Motion=Y_3)  # -> Geometry, Transform
move_2 = Move(Geometry=[bzspan.Curve, rec_2pt.Rectangle, dash.Dashes], Motion=Y_4)  # -> Geometry, Transform
move_3 = Move(Geometry=[bzspan.Curve, rec_2pt.Rectangle, dash.Dashes], Motion=Y_5)  # -> Geometry, Transform
move_4 = Move(Geometry=[bzspan.Curve, rec_2pt.Rectangle, dash.Dashes], Motion=Y_6)  # -> Geometry, Transform
move_5 = Move(Geometry=[bzspan.Curve, rec_2pt.Rectangle, dash.Dashes], Motion=Y_7)  # -> Geometry, Transform
move_6 = Move(Geometry=[bzspan.Curve, rec_2pt.Rectangle, dash.Dashes], Motion=Y_8)  # -> Geometry, Transform
move_7 = Move(Geometry=[bzspan.Curve, rec_2pt.Rectangle, dash.Dashes], Motion=Y_9)  # -> Geometry, Transform
move_8 = Move(Geometry=[bzspan.Curve, rec_2pt.Rectangle, dash.Dashes], Motion=Y_10)  # -> Geometry, Transform
move_9 = Move(Geometry=[bzspan.Curve, rec_2pt.Rectangle, dash.Dashes], Motion=Y_11)  # -> Geometry, Transform
previewlw = CustomPreviewLineweights(
    Geometry=[bzspan.Curve, rec_2pt.Rectangle, dash.Dashes, move.Geometry],
    Shader="black",
    Thickness=Slider(0.005, range=0..1),
    Absolute=True)
move_10 = Move(Geometry=[bzspan.Curve, rec_2pt.Rectangle, dash.Dashes], Motion=Y_12)  # -> Geometry, Transform
move_11 = Move(Geometry=[bzspan.Curve, rec_2pt.Rectangle, dash.Dashes], Motion=Y_13)  # -> Geometry, Transform
