# Grasshopper definition KNNtrain.gh (Grasshopper 1.0.7)
# plug-ins: Kangaroo2 Components

button = Button()
panel = Panel("C:\Users\KarlRoesch\Desktop\karldesktopfolder\bracket\trainform\mortise")
panel_2 = Panel("C:\Users\KarlRoesch\Desktop\karldesktopfolder\bracket\trainform\mortise\train_mortise.3dm")
panel_3 = Panel("C:\Users\KarlRoesch\Desktop\karldesktopfolder\bracket\trainform\tenon")
panel_4 = Panel("C:\Users\KarlRoesch\Desktop\karldesktopfolder\bracket\trainform\tenon\train_tenon.3dm")
panel_5 = Panel("C:\Users\KarlRoesch\Desktop\karldesktopfolder\bracket\trainform\ridge\train_ridge.3dm")
panel_6 = Panel("C:\Users\KarlRoesch\Desktop\karldesktopfolder\bracket\trainform\ridge")
panel_7 = Panel("C:\Users\KarlRoesch\Desktop\karldesktopfolder\bracket\trainform\flange\train_flange.3dm")
panel_8 = Panel("C:\Users\KarlRoesch\Desktop\karldesktopfolder\bracket\trainform\flange")
panel_9 = Panel("C:\Users\KarlRoesch\Desktop\karldesktopfolder\bracket\trainform\plane")
panel_10 = Panel("C:\Users\KarlRoesch\Desktop\karldesktopfolder\bracket\trainform\plane\train_plane.3dm")
panel_11 = Panel("C:\Users\KarlRoesch\Desktop\karldesktopfolder\bracket\trainform\hole")
panel_12 = Panel("C:\Users\KarlRoesch\Desktop\karldesktopfolder\bracket\trainform\hole\train_hole.3dm")
panel_13 = Panel("C:\Users\KarlRoesch\Desktop\karldesktopfolder\bracket\trainform\dowel\train_dowel.3dm")
panel_14 = Panel("C:\Users\KarlRoesch\Desktop\karldesktopfolder\bracket\trainform\dowel")
panel_15 = Panel("C:\Users\KarlRoesch\Desktop\karldesktopfolder\bracket\trainform\fillet")
panel_16 = Panel("C:\Users\KarlRoesch\Desktop\karldesktopfolder\bracket\trainform\fillet\train_fillet.3dm")
panel_17 = Panel("C:\Users\KarlRoesch\Desktop\karldesktopfolder\bracket\trainform\strut\train_strut.3dm")
panel_18 = Panel("C:\Users\KarlRoesch\Desktop\karldesktopfolder\bracket\trainform\strut")
panel_19 = Panel("C:\Users\KarlRoesch\Desktop\karldesktopfolder\bracket\trainform\blade")
panel_20 = Panel("C:\Users\KarlRoesch\Desktop\karldesktopfolder\bracket\trainform\blade\train_blade.3dm")
panel_21 = Panel("C:\Users\KarlRoesch\Desktop\karldesktopfolder\bracket\trainform\cone\train_cone.3dm")
panel_22 = Panel("C:\Users\KarlRoesch\Desktop\karldesktopfolder\bracket\trainform\cone")
panel_23 = Panel("C:\Users\KarlRoesch\Desktop\karldesktopfolder\bracket\trainform\bar\train_bar.3dm")
panel_24 = Panel("C:\Users\KarlRoesch\Desktop\karldesktopfolder\bracket\trainform\bar")
_3dm = Import3DM(File=panel_2, Layer="*", Name="*")
_3dm_2 = Import3DM(File=panel_4, Layer="*", Name="*")
_3dm_3 = Import3DM(File=panel_5, Layer="*", Name="*")
_3dm_4 = Import3DM(File=panel_7, Layer="*", Name="*")
bbox = BoundingBox(Content=_3dm, Plane=PlaneXY(0, 0, 0), UnionBox=True)  # -> Box, Box_2
_3dm_5 = Import3DM(File=panel_10, Layer="*", Name="*")
_3dm_6 = Import3DM(File=panel_12, Layer="*", Name="*")
debox = DeconstructBox(Box=bbox.Box_2)  # -> Plane, X, Y, Z
bbox_2 = BoundingBox(Content=_3dm_2, Plane=PlaneXY(0, 0, 0), UnionBox=True)  # -> Box, Box_2
bbox_3 = BoundingBox(Content=_3dm_3, Plane=PlaneXY(0, 0, 0), UnionBox=True)  # -> Box, Box_2
_3dm_7 = Import3DM(File=panel_13, Layer="*", Name="*")
_3dm_8 = Import3DM(File=panel_16, Layer="*", Name="*")
debox_2 = DeconstructBox(Box=bbox_2.Box_2)  # -> Plane, X, Y, Z
_3dm_9 = Import3DM(File=panel_17, Layer="*", Name="*")
debox_3 = DeconstructBox(Box=bbox_3.Box_2)  # -> Plane, X, Y, Z
_3dm_10 = Import3DM(File=panel_20, Layer="*", Name="*")
bbox_4 = BoundingBox(Content=_3dm_4, Plane=PlaneXY(0, 0, 0), UnionBox=True)  # -> Box, Box_2
_3dm_11 = Import3DM(File=panel_21, Layer="*", Name="*")
_3dm_12 = Import3DM(File=panel_23, Layer="*", Name="*")
debrep = DeconstructBrep(Brep=bbox.Box_2)  # -> Faces, Edges, Vertices
bbox_5 = BoundingBox(Content=_3dm_5, Plane=PlaneXY(0, 0, 0), UnionBox=True)  # -> Box, Box_2
debox_4 = DeconstructBox(Box=bbox_4.Box_2)  # -> Plane, X, Y, Z
bbox_6 = BoundingBox(Content=_3dm_6, Plane=PlaneXY(0, 0, 0), UnionBox=True)  # -> Box, Box_2
xy = XYPlane(Origin=Point(0, 0, 0))
debox_5 = DeconstructBox(Box=bbox_5.Box_2)  # -> Plane, X, Y, Z
debrep_2 = DeconstructBrep(Brep=bbox_2.Box_2)  # -> Faces, Edges, Vertices
debox_6 = DeconstructBox(Box=bbox_6.Box_2)  # -> Plane, X, Y, Z
bbox_7 = BoundingBox(Content=_3dm_7, Plane=PlaneXY(0, 0, 0), UnionBox=True)  # -> Box, Box_2
debrep_3 = DeconstructBrep(Brep=bbox_3.Box_2)  # -> Faces, Edges, Vertices
item = ListItem(List=debrep.Faces, Index=0, Wrap=True)
bbox_8 = BoundingBox(Content=_3dm_8, Plane=PlaneXY(0, 0, 0), UnionBox=True)  # -> Box, Box_2
xy_2 = XYPlane(Origin=Point(0, 0, 0))
bbox_9 = BoundingBox(Content=_3dm_9, Plane=PlaneXY(0, 0, 0), UnionBox=True)  # -> Box, Box_2
xy_3 = XYPlane(Origin=Point(0, 0, 0))
bbox_10 = BoundingBox(Content=_3dm_10, Plane=PlaneXY(0, 0, 0), UnionBox=True)  # -> Box, Box_2
debox_7 = DeconstructBox(Box=bbox_7.Box_2)  # -> Plane, X, Y, Z
item_2 = ListItem(List=debrep_2.Faces, Index=0, Wrap=True)
bbox_11 = BoundingBox(Content=_3dm_11, Plane=PlaneXY(0, 0, 0), UnionBox=True)  # -> Box, Box_2
debox_8 = DeconstructBox(Box=bbox_8.Box_2)  # -> Plane, X, Y, Z
debrep_4 = DeconstructBrep(Brep=bbox_4.Box_2)  # -> Faces, Edges, Vertices
item_3 = ListItem(List=debrep_3.Faces, Index=0, Wrap=True)
debox_9 = DeconstructBox(Box=bbox_9.Box_2)  # -> Plane, X, Y, Z
orient = Orient(Geometry=bbox.Box_2, Source=item, Target=xy)  # -> Geometry, Transform
debox_10 = DeconstructBox(Box=bbox_10.Box_2)  # -> Plane, X, Y, Z
bbox_12 = BoundingBox(Content=_3dm_12, Plane=PlaneXY(0, 0, 0), UnionBox=True)  # -> Box, Box_2
orient_2 = Orient(Geometry=_3dm, Source=item, Target=xy)  # -> Geometry, Transform
xy_4 = XYPlane(Origin=Point(0, 0, 0))
debrep_5 = DeconstructBrep(Brep=bbox_5.Box_2)  # -> Faces, Edges, Vertices
debox_11 = DeconstructBox(Box=bbox_11.Box_2)  # -> Plane, X, Y, Z
debrep_6 = DeconstructBrep(Brep=bbox_6.Box_2)  # -> Faces, Edges, Vertices
item_4 = ListItem(List=debrep_4.Faces, Index=0, Wrap=True)
debox_12 = DeconstructBox(Box=bbox_12.Box_2)  # -> Plane, X, Y, Z
orient_3 = Orient(Geometry=bbox_2.Box_2, Source=item_2, Target=xy_2)  # -> Geometry, Transform
xy_5 = XYPlane(Origin=Point(0, 0, 0))
xy_6 = XYPlane(Origin=Point(0, 0, 0))
orient_4 = Orient(Geometry=bbox_3.Box_2, Source=item_3, Target=xy_3)  # -> Geometry, Transform
orient_5 = Orient(Geometry=_3dm_2, Source=item_2, Target=xy_2)  # -> Geometry, Transform
orient_6 = Orient(Geometry=_3dm_3, Source=item_3, Target=xy_3)  # -> Geometry, Transform
debrep_7 = DeconstructBrep(Brep=bbox_7.Box_2)  # -> Faces, Edges, Vertices
item_5 = ListItem(List=debrep_5.Faces, Index=0, Wrap=True)
debrep_8 = DeconstructBrep(Brep=orient.Geometry)  # -> Faces, Edges, Vertices
item_6 = ListItem(List=debrep_6.Faces, Index=0, Wrap=True)
debrep_9 = DeconstructBrep(Brep=bbox_8.Box_2)  # -> Faces, Edges, Vertices
debrep_10 = DeconstructBrep(Brep=bbox_9.Box_2)  # -> Faces, Edges, Vertices
triremesh = TriRemesh(Geometry=orient_2.Geometry, Length=Slider(1, range=0..10), Iterations=25)  # -> Triangulation, Dual, Creases
xy_7 = XYPlane(Origin=Point(0, 0, 0))
debrep_11 = DeconstructBrep(Brep=bbox_10.Box_2)  # -> Faces, Edges, Vertices
orient_7 = Orient(Geometry=bbox_4.Box_2, Source=item_4, Target=xy_4)  # -> Geometry, Transform
xy_8 = XYPlane(Origin=Point(0, 0, 0))
orient_8 = Orient(Geometry=_3dm_4, Source=item_4, Target=xy_4)  # -> Geometry, Transform
debrep_12 = DeconstructBrep(Brep=bbox_11.Box_2)  # -> Faces, Edges, Vertices
debrep_13 = DeconstructBrep(Brep=orient_3.Geometry)  # -> Faces, Edges, Vertices
xy_9 = XYPlane(Origin=Point(0, 0, 0))
item_7 = ListItem(List=debrep_7.Faces, Index=0, Wrap=True)
xy_10 = XYPlane(Origin=Point(0, 0, 0))
debrep_14 = DeconstructBrep(Brep=orient_4.Geometry)  # -> Faces, Edges, Vertices
item_8 = ListItem(List=debrep_8.Faces, Index=0, Wrap=True)
item_9 = ListItem(List=debrep_9.Faces, Index=0, Wrap=True)
orient_9 = Orient(Geometry=bbox_5.Box_2, Source=item_5, Target=xy_5)  # -> Geometry, Transform
debrep_15 = DeconstructBrep(Brep=bbox_12.Box_2)  # -> Faces, Edges, Vertices
triremesh_2 = TriRemesh(Geometry=orient_5.Geometry, Length=Slider(1, range=0..10), Iterations=25)  # -> Triangulation, Dual, Creases
orient_10 = Orient(Geometry=bbox_6.Box_2, Source=item_6, Target=xy_6)  # -> Geometry, Transform
xy_11 = XYPlane(Origin=Point(0, 0, 0))
orient_11 = Orient(Geometry=_3dm_5, Source=item_5, Target=xy_5)  # -> Geometry, Transform
item_10 = ListItem(List=debrep_10.Faces, Index=0, Wrap=True)
triremesh_3 = TriRemesh(Geometry=orient_6.Geometry, Length=Slider(1, range=0..10), Iterations=25)  # -> Triangulation, Dual, Creases
orient_12 = Orient(Geometry=_3dm_6, Source=item_6, Target=xy_6)  # -> Geometry, Transform
item_11 = ListItem(List=debrep_11.Faces, Index=0, Wrap=True)
xy_12 = XYPlane(Origin=Point(0, 0, 0))
item_12 = ListItem(List=debrep_12.Faces, Index=0, Wrap=True)
area = Area(Geometry=item_8)  # -> Area, Centroid
item_13 = ListItem(List=debrep_13.Faces, Index=0, Wrap=True)
debrep_16 = DeconstructBrep(Brep=orient_7.Geometry)  # -> Faces, Edges, Vertices
item_14 = ListItem(List=debrep_14.Faces, Index=0, Wrap=True)
orient_13 = Orient(Geometry=bbox_7.Box_2, Source=item_7, Target=xy_7)  # -> Geometry, Transform
item_15 = ListItem(List=debrep_15.Faces, Index=0, Wrap=True)
triremesh_4 = TriRemesh(Geometry=orient_8.Geometry, Length=Slider(1, range=0..10), Iterations=25)  # -> Triangulation, Dual, Creases
orient_14 = Orient(Geometry=bbox_8.Box_2, Source=item_9, Target=xy_8)  # -> Geometry, Transform
orient_15 = Orient(Geometry=_3dm_7, Source=item_7, Target=xy_7)  # -> Geometry, Transform
orient_16 = Orient(Geometry=_3dm_8, Source=item_9, Target=xy_8)  # -> Geometry, Transform
debrep_17 = DeconstructBrep(Brep=orient_9.Geometry)  # -> Faces, Edges, Vertices
orient_17 = Orient(Geometry=bbox_9.Box_2, Source=item_10, Target=xy_9)  # -> Geometry, Transform
debrep_18 = DeconstructBrep(Brep=orient_10.Geometry)  # -> Faces, Edges, Vertices
area_2 = Area(Geometry=item_13)  # -> Area, Centroid
orient_18 = Orient(Geometry=bbox_10.Box_2, Source=item_11, Target=xy_10)  # -> Geometry, Transform
orient_19 = Orient(Geometry=_3dm_9, Source=item_10, Target=xy_9)  # -> Geometry, Transform
area_3 = Area(Geometry=item_14)  # -> Area, Centroid
triremesh_5 = TriRemesh(Geometry=orient_11.Geometry, Length=Slider(1, range=0..10), Iterations=25)  # -> Triangulation, Dual, Creases
orient_20 = Orient(Geometry=_3dm_10, Source=item_11, Target=xy_10)  # -> Geometry, Transform
orient_21 = Orient(Geometry=bbox_11.Box_2, Source=item_12, Target=xy_11)  # -> Geometry, Transform
item_16 = ListItem(List=debrep_16.Faces, Index=0, Wrap=True)
triremesh_6 = TriRemesh(Geometry=orient_12.Geometry, Length=Slider(1, range=0..10), Iterations=25)  # -> Triangulation, Dual, Creases
pt = ConstructPoint(XCoordinate=0, YCoordinate=0, ZCoordinate=0)
orient_22 = Orient(Geometry=_3dm_11, Source=item_12, Target=xy_11)  # -> Geometry, Transform
orient_23 = Orient(Geometry=bbox_12.Box_2, Source=item_15, Target=xy_12)  # -> Geometry, Transform
debrep_19 = DeconstructBrep(Brep=orient_13.Geometry)  # -> Faces, Edges, Vertices
item_17 = ListItem(List=debrep_17.Faces, Index=0, Wrap=True)
orient_24 = Orient(Geometry=_3dm_12, Source=item_15, Target=xy_12)  # -> Geometry, Transform
item_18 = ListItem(List=debrep_18.Faces, Index=0, Wrap=True)
debrep_20 = DeconstructBrep(Brep=orient_14.Geometry)  # -> Faces, Edges, Vertices
area_4 = Area(Geometry=item_16)  # -> Area, Centroid
triremesh_7 = TriRemesh(Geometry=orient_15.Geometry, Length=Slider(1, range=0..10), Iterations=25)  # -> Triangulation, Dual, Creases
pt_2 = ConstructPoint(XCoordinate=0, YCoordinate=0, ZCoordinate=0)
debrep_21 = DeconstructBrep(Brep=orient_17.Geometry)  # -> Faces, Edges, Vertices
Y = UnitY(Factor=1)
triremesh_8 = TriRemesh(Geometry=orient_16.Geometry, Length=Slider(1, range=0..10), Iterations=25)  # -> Triangulation, Dual, Creases
pt_3 = ConstructPoint(XCoordinate=0, YCoordinate=0, ZCoordinate=0)
debrep_22 = DeconstructBrep(Brep=orient_18.Geometry)  # -> Faces, Edges, Vertices
triremesh_9 = TriRemesh(Geometry=orient_19.Geometry, Length=Slider(1, range=0..10), Iterations=25)  # -> Triangulation, Dual, Creases
area_5 = Area(Geometry=item_17)  # -> Area, Centroid
debrep_23 = DeconstructBrep(Brep=orient_21.Geometry)  # -> Faces, Edges, Vertices
Z = UnitZ(Factor=1)
X = UnitX(Factor=1)
triremesh_10 = TriRemesh(Geometry=orient_20.Geometry, Length=Slider(1, range=0..10), Iterations=25)  # -> Triangulation, Dual, Creases
area_6 = Area(Geometry=item_18)  # -> Area, Centroid
item_19 = ListItem(List=debrep_19.Faces, Index=0, Wrap=True)
triremesh_11 = TriRemesh(Geometry=orient_22.Geometry, Length=Slider(1, range=0..10), Iterations=25)  # -> Triangulation, Dual, Creases
item_20 = ListItem(List=debrep_20.Faces, Index=0, Wrap=True)
debrep_24 = DeconstructBrep(Brep=orient_23.Geometry)  # -> Faces, Edges, Vertices
Y_2 = UnitY(Factor=1)
pt_4 = ConstructPoint(XCoordinate=0, YCoordinate=0, ZCoordinate=0)
item_21 = ListItem(List=debrep_21.Faces, Index=0, Wrap=True)
Y_3 = UnitY(Factor=1)
item_22 = ListItem(List=debrep_22.Faces, Index=0, Wrap=True)
triremesh_12 = TriRemesh(Geometry=orient_24.Geometry, Length=Slider(1, range=0..10), Iterations=25)  # -> Triangulation, Dual, Creases
Z_2 = UnitZ(Factor=1)
X_2 = UnitX(Factor=1)
contour = Contour(Shape=triremesh.Triangulation, Point=pt, Direction=Y, Distance="1")  # -> flatten(Contours)
area_7 = Area(Geometry=item_19)  # -> Area, Centroid
Z_3 = UnitZ(Factor=1)
X_3 = UnitX(Factor=1)
item_23 = ListItem(List=debrep_23.Faces, Index=0, Wrap=True)
area_8 = Area(Geometry=item_20)  # -> Area, Centroid
contour_2 = Contour(Shape=triremesh.Triangulation, Point=pt, Direction=Z, Distance="1")  # -> flatten(Contours)
pt_5 = ConstructPoint(XCoordinate=0, YCoordinate=0, ZCoordinate=0)
contour_3 = Contour(Shape=triremesh.Triangulation, Point=pt, Direction=X, Distance="1")  # -> flatten(Contours)
pt_6 = ConstructPoint(XCoordinate=0, YCoordinate=0, ZCoordinate=0)
area_9 = Area(Geometry=item_21)  # -> Area, Centroid
item_24 = ListItem(List=debrep_24.Faces, Index=0, Wrap=True)
area_10 = Area(Geometry=item_22)  # -> Area, Centroid
Y_4 = UnitY(Factor=1)
contour_4 = Contour(Shape=triremesh_2.Triangulation, Point=pt_2, Direction=Y_2, Distance="1")  # -> flatten(Contours)
area_11 = Area(Geometry=item_23)  # -> Area, Centroid
contour_5 = Contour(Shape=triremesh_3.Triangulation, Point=pt_3, Direction=Y_3, Distance="1")  # -> flatten(Contours)
Z_4 = UnitZ(Factor=1)
X_4 = UnitX(Factor=1)
contour_6 = Contour(Shape=triremesh_2.Triangulation, Point=pt_2, Direction=Z_2, Distance="1")  # -> flatten(Contours)
contour_7 = Contour(Shape=triremesh_2.Triangulation, Point=pt_2, Direction=X_2, Distance="1")  # -> flatten(Contours)
Y_5 = UnitY(Factor=1)
pt_7 = ConstructPoint(XCoordinate=0, YCoordinate=0, ZCoordinate=0)
contour_8 = Contour(Shape=triremesh_3.Triangulation, Point=pt_3, Direction=Z_3, Distance="1")  # -> flatten(Contours)
area_12 = Area(Geometry=item_24)  # -> Area, Centroid
contour_9 = Contour(Shape=triremesh_3.Triangulation, Point=pt_3, Direction=X_3, Distance="1")  # -> flatten(Contours)
Y_6 = UnitY(Factor=1)
pt_8 = ConstructPoint(XCoordinate=0, YCoordinate=0, ZCoordinate=0)
Z_5 = UnitZ(Factor=1)
X_5 = UnitX(Factor=1)
pt_9 = ConstructPoint(XCoordinate=0, YCoordinate=0, ZCoordinate=0)
Z_6 = UnitZ(Factor=1)
X_6 = UnitX(Factor=1)
contour_10 = Contour(Shape=triremesh_4.Triangulation, Point=pt_4, Direction=Y_4, Distance="1")  # -> flatten(Contours)
pt_10 = ConstructPoint(XCoordinate=0, YCoordinate=0, ZCoordinate=0)
mcx = MultipleCurves(Curves=[contour_3, contour, contour_2])  # -> Points, IndexA, IndexB, ParamA, ParamB
pt_11 = ConstructPoint(XCoordinate=0, YCoordinate=0, ZCoordinate=0)
contour_11 = Contour(Shape=triremesh_4.Triangulation, Point=pt_4, Direction=Z_4, Distance="1")  # -> flatten(Contours)
Y_7 = UnitY(Factor=1)
contour_12 = Contour(Shape=triremesh_4.Triangulation, Point=pt_4, Direction=X_4, Distance="1")  # -> flatten(Contours)
Y_8 = UnitY(Factor=1)
contour_13 = Contour(Shape=triremesh_5.Triangulation, Point=pt_5, Direction=Y_5, Distance="1")  # -> flatten(Contours)
contour_14 = Contour(Shape=triremesh_6.Triangulation, Point=pt_6, Direction=Y_6, Distance="1")  # -> flatten(Contours)
Z_7 = UnitZ(Factor=1)
pt_12 = ConstructPoint(XCoordinate=0, YCoordinate=0, ZCoordinate=0)
X_7 = UnitX(Factor=1)
Y_9 = UnitY(Factor=1)
contour_15 = Contour(Shape=triremesh_5.Triangulation, Point=pt_5, Direction=Z_5, Distance="1")  # -> flatten(Contours)
Z_8 = UnitZ(Factor=1)
Y_10 = UnitY(Factor=1)
X_8 = UnitX(Factor=1)
mcx_2 = MultipleCurves(Curves=[contour_7, contour_4, contour_6])  # -> Points, IndexA, IndexB, ParamA, ParamB
contour_16 = Contour(Shape=triremesh_5.Triangulation, Point=pt_5, Direction=X_5, Distance="1")  # -> flatten(Contours)
contour_17 = Contour(Shape=triremesh_6.Triangulation, Point=pt_6, Direction=Z_6, Distance="1")  # -> flatten(Contours)
contour_18 = Contour(Shape=triremesh_6.Triangulation, Point=pt_6, Direction=X_6, Distance="1")  # -> flatten(Contours)
mcx_3 = MultipleCurves(Curves=[contour_9, contour_5, contour_8])  # -> Points, IndexA, IndexB, ParamA, ParamB
Z_9 = UnitZ(Factor=1)
X_9 = UnitX(Factor=1)
Y_11 = UnitY(Factor=1)
Z_10 = UnitZ(Factor=1)
X_10 = UnitX(Factor=1)
panel_25 = Panel("""0
1
2""")
contour_19 = Contour(Shape=triremesh_7.Triangulation, Point=pt_7, Direction=Y_7, Distance="1")  # -> flatten(Contours)
Z_11 = UnitZ(Factor=1)
X_11 = UnitX(Factor=1)
Y_12 = UnitY(Factor=1)
contour_20 = Contour(Shape=triremesh_8.Triangulation, Point=pt_8, Direction=Y_8, Distance="1")  # -> flatten(Contours)
contour_21 = Contour(Shape=triremesh_7.Triangulation, Point=pt_7, Direction=Z_7, Distance="1")  # -> flatten(Contours)
contour_22 = Contour(Shape=triremesh_7.Triangulation, Point=pt_7, Direction=X_7, Distance="1")  # -> flatten(Contours)
contour_23 = Contour(Shape=triremesh_9.Triangulation, Point=pt_9, Direction=Y_9, Distance="1")  # -> flatten(Contours)
Z_12 = UnitZ(Factor=1)
X_12 = UnitX(Factor=1)
mcx_4 = MultipleCurves(Curves=[contour_12, contour_10, contour_11])  # -> Points, IndexA, IndexB, ParamA, ParamB
contour_24 = Contour(Shape=triremesh_8.Triangulation, Point=pt_8, Direction=Z_8, Distance="1")  # -> flatten(Contours)
contour_25 = Contour(Shape=triremesh_10.Triangulation, Point=pt_10, Direction=Y_10, Distance="1")  # -> flatten(Contours)
contour_26 = Contour(Shape=triremesh_8.Triangulation, Point=pt_8, Direction=X_8, Distance="1")  # -> flatten(Contours)
sift = SiftPattern(List=mcx.Points, SiftPattern=panel_25)  # -> Output0, Output1, Output2
panel_26 = Panel("""0
1
2""")
contour_27 = Contour(Shape=triremesh_9.Triangulation, Point=pt_9, Direction=Z_9, Distance="1")  # -> flatten(Contours)
contour_28 = Contour(Shape=triremesh_9.Triangulation, Point=pt_9, Direction=X_9, Distance="1")  # -> flatten(Contours)
contour_29 = Contour(Shape=triremesh_11.Triangulation, Point=pt_11, Direction=Y_11, Distance="1")  # -> flatten(Contours)
panel_27 = Panel("""0
1
2""")
contour_30 = Contour(Shape=triremesh_10.Triangulation, Point=pt_10, Direction=Z_10, Distance="1")  # -> flatten(Contours)
contour_31 = Contour(Shape=triremesh_10.Triangulation, Point=pt_10, Direction=X_10, Distance="1")  # -> flatten(Contours)
mcx_5 = MultipleCurves(Curves=[contour_16, contour_13, contour_15])  # -> Points, IndexA, IndexB, ParamA, ParamB
contour_32 = Contour(Shape=triremesh_11.Triangulation, Point=pt_11, Direction=Z_11, Distance="1")  # -> flatten(Contours)
mcx_6 = MultipleCurves(Curves=[contour_18, contour_14, contour_17])  # -> Points, IndexA, IndexB, ParamA, ParamB
contour_33 = Contour(Shape=triremesh_11.Triangulation, Point=pt_11, Direction=X_11, Distance="1")  # -> flatten(Contours)
contour_34 = Contour(Shape=triremesh_12.Triangulation, Point=pt_12, Direction=Y_12, Distance="1")  # -> flatten(Contours)
sift_2 = SiftPattern(List=mcx_2.Points, SiftPattern=panel_26)  # -> Output0, Output1, Output2
sift_3 = SiftPattern(List=mcx_3.Points, SiftPattern=panel_27)  # -> Output0, Output1, Output2
clean = CleanTree(RemoveNulls=True, RemoveInvalid=True, RemoveEmpty=False, Tree=sift.Output0)
contour_35 = Contour(Shape=triremesh_12.Triangulation, Point=pt_12, Direction=Z_12, Distance="1")  # -> flatten(Contours)
clean_2 = CleanTree(RemoveNulls=True, RemoveInvalid=True, RemoveEmpty=False, Tree=sift.Output1)
clean_3 = CleanTree(RemoveNulls=True, RemoveInvalid=True, RemoveEmpty=False, Tree=sift.Output2)
contour_36 = Contour(Shape=triremesh_12.Triangulation, Point=pt_12, Direction=X_12, Distance="1")  # -> flatten(Contours)
panel_28 = Panel("""0
1
2""")
mcx_7 = MultipleCurves(Curves=[contour_22, contour_19, contour_21])  # -> Points, IndexA, IndexB, ParamA, ParamB
mcx_8 = MultipleCurves(Curves=[contour_26, contour_20, contour_24])  # -> Points, IndexA, IndexB, ParamA, ParamB
panel_29 = Panel("""0
1
2""")
clean_4 = CleanTree(RemoveNulls=True, RemoveInvalid=True, RemoveEmpty=False, Tree=sift_2.Output0)
clean_5 = CleanTree(RemoveNulls=True, RemoveInvalid=True, RemoveEmpty=False, Tree=sift_2.Output1)
clean_6 = CleanTree(RemoveNulls=True, RemoveInvalid=True, RemoveEmpty=False, Tree=sift_2.Output2)
panel_30 = Panel("""0
1
2""")
sift_4 = SiftPattern(List=mcx_4.Points, SiftPattern=panel_28)  # -> Output0, Output1, Output2
mcx_9 = MultipleCurves(Curves=[contour_28, contour_23, contour_27])  # -> Points, IndexA, IndexB, ParamA, ParamB
clean_7 = CleanTree(RemoveNulls=True, RemoveInvalid=True, RemoveEmpty=False, Tree=sift_3.Output0)
clean_8 = CleanTree(RemoveNulls=True, RemoveInvalid=True, RemoveEmpty=False, Tree=sift_3.Output1)
mcx_10 = MultipleCurves(Curves=[contour_31, contour_25, contour_30])  # -> Points, IndexA, IndexB, ParamA, ParamB
clean_9 = CleanTree(RemoveNulls=True, RemoveInvalid=True, RemoveEmpty=False, Tree=sift_3.Output2)
pdecon = Deconstruct(Point=clean)  # -> XComponent, YComponent, ZComponent
pdecon_2 = Deconstruct(Point=clean_3)  # -> XComponent, YComponent, ZComponent
pdecon_3 = Deconstruct(Point=clean_2)  # -> XComponent, YComponent, ZComponent
mcx_11 = MultipleCurves(Curves=[contour_33, contour_29, contour_32])  # -> Points, IndexA, IndexB, ParamA, ParamB
sift_5 = SiftPattern(List=mcx_5.Points, SiftPattern=panel_29)  # -> Output0, Output1, Output2
sift_6 = SiftPattern(List=mcx_6.Points, SiftPattern=panel_30)  # -> Output0, Output1, Output2
panel_31 = Panel("""0
1
2""")
mcx_12 = MultipleCurves(Curves=[contour_36, contour_34, contour_35])  # -> Points, IndexA, IndexB, ParamA, ParamB
clean_10 = CleanTree(RemoveNulls=True, RemoveInvalid=True, RemoveEmpty=False, Tree=sift_4.Output0)
clean_11 = CleanTree(RemoveNulls=True, RemoveInvalid=True, RemoveEmpty=False, Tree=sift_4.Output1)
panel_32 = Panel("""0
1
2""")
clean_12 = CleanTree(RemoveNulls=True, RemoveInvalid=True, RemoveEmpty=False, Tree=sift_4.Output2)
pt_13 = ConstructPoint(XCoordinate=pdecon.XComponent, YCoordinate=pdecon.YComponent, ZCoordinate=pdecon.ZComponent)
pt_14 = ConstructPoint(XCoordinate=pdecon_2.XComponent, YCoordinate=pdecon_2.YComponent, ZCoordinate=pdecon_2.ZComponent)
pdecon_4 = Deconstruct(Point=clean_4)  # -> XComponent, YComponent, ZComponent
pdecon_5 = Deconstruct(Point=clean_6)  # -> XComponent, YComponent, ZComponent
pt_15 = ConstructPoint(XCoordinate=pdecon_3.XComponent, YCoordinate=pdecon_3.YComponent, ZCoordinate=pdecon_3.ZComponent)
pdecon_6 = Deconstruct(Point=clean_5)  # -> XComponent, YComponent, ZComponent
pdecon_7 = Deconstruct(Point=clean_7)  # -> XComponent, YComponent, ZComponent
pdecon_8 = Deconstruct(Point=clean_9)  # -> XComponent, YComponent, ZComponent
panel_33 = Panel("""0
1
2""")
pdecon_9 = Deconstruct(Point=clean_8)  # -> XComponent, YComponent, ZComponent
panel_34 = Panel("""0
1
2""")
sift_7 = SiftPattern(List=mcx_7.Points, SiftPattern=panel_31)  # -> Output0, Output1, Output2
clean_13 = CleanTree(RemoveNulls=True, RemoveInvalid=True, RemoveEmpty=False, Tree=sift_5.Output0)
clean_14 = CleanTree(RemoveNulls=True, RemoveInvalid=True, RemoveEmpty=False, Tree=sift_5.Output1)
clean_15 = CleanTree(RemoveNulls=True, RemoveInvalid=True, RemoveEmpty=False, Tree=sift_5.Output2)
panel_35 = Panel("""0
1
2""")
clean_16 = CleanTree(RemoveNulls=True, RemoveInvalid=True, RemoveEmpty=False, Tree=sift_6.Output0)
clean_17 = CleanTree(RemoveNulls=True, RemoveInvalid=True, RemoveEmpty=False, Tree=sift_6.Output1)
sift_8 = SiftPattern(List=mcx_8.Points, SiftPattern=panel_32)  # -> Output0, Output1, Output2
clean_18 = CleanTree(RemoveNulls=True, RemoveInvalid=True, RemoveEmpty=False, Tree=sift_6.Output2)
pt_16 = ConstructPoint(XCoordinate=pdecon_4.XComponent, YCoordinate=pdecon_4.YComponent, ZCoordinate=pdecon_4.ZComponent)
pt_17 = ConstructPoint(XCoordinate=pdecon_5.XComponent, YCoordinate=pdecon_5.YComponent, ZCoordinate=pdecon_5.ZComponent)
pt_18 = ConstructPoint(XCoordinate=pdecon_6.XComponent, YCoordinate=pdecon_6.YComponent, ZCoordinate=pdecon_6.ZComponent)
sift_9 = SiftPattern(List=mcx_9.Points, SiftPattern=panel_33)  # -> Output0, Output1, Output2
pt_19 = ConstructPoint(XCoordinate=pdecon_7.XComponent, YCoordinate=pdecon_7.YComponent, ZCoordinate=pdecon_7.ZComponent)
pt_20 = ConstructPoint(XCoordinate=pdecon_8.XComponent, YCoordinate=pdecon_8.YComponent, ZCoordinate=pdecon_8.ZComponent)
pt_21 = ConstructPoint(XCoordinate=pdecon_9.XComponent, YCoordinate=pdecon_9.YComponent, ZCoordinate=pdecon_9.ZComponent)
sift_10 = SiftPattern(List=mcx_10.Points, SiftPattern=panel_34)  # -> Output0, Output1, Output2
panel_36 = Panel("""0
1
2""")
pdecon_10 = Deconstruct(Point=clean_10)  # -> XComponent, YComponent, ZComponent
pdecon_11 = Deconstruct(Point=clean_12)  # -> XComponent, YComponent, ZComponent
pdecon_12 = Deconstruct(Point=clean_11)  # -> XComponent, YComponent, ZComponent
sift_11 = SiftPattern(List=mcx_11.Points, SiftPattern=panel_35)  # -> Output0, Output1, Output2
centroid = Centroid(PointA=pt_13, PointB=pt_15, PointC=pt_14)  # -> Centroid, MedianAB, MedianBC, MedianCA
clean_19 = CleanTree(RemoveNulls=True, RemoveInvalid=True, RemoveEmpty=False, Tree=sift_7.Output0)
clean_20 = CleanTree(RemoveNulls=True, RemoveInvalid=True, RemoveEmpty=False, Tree=sift_7.Output1)
clean_21 = CleanTree(RemoveNulls=True, RemoveInvalid=True, RemoveEmpty=False, Tree=sift_7.Output2)
clean_22 = CleanTree(RemoveNulls=True, RemoveInvalid=True, RemoveEmpty=False, Tree=sift_8.Output0)
pdecon_13 = Deconstruct(Point=clean_13)  # -> XComponent, YComponent, ZComponent
pdecon_14 = Deconstruct(Point=clean_15)  # -> XComponent, YComponent, ZComponent
clean_23 = CleanTree(RemoveNulls=True, RemoveInvalid=True, RemoveEmpty=False, Tree=sift_8.Output1)
pdecon_15 = Deconstruct(Point=clean_14)  # -> XComponent, YComponent, ZComponent
clean_24 = CleanTree(RemoveNulls=True, RemoveInvalid=True, RemoveEmpty=False, Tree=sift_8.Output2)
sift_12 = SiftPattern(List=mcx_12.Points, SiftPattern=panel_36)  # -> Output0, Output1, Output2
pdecon_16 = Deconstruct(Point=clean_16)  # -> XComponent, YComponent, ZComponent
pdecon_17 = Deconstruct(Point=clean_18)  # -> XComponent, YComponent, ZComponent
pdecon_18 = Deconstruct(Point=clean_17)  # -> XComponent, YComponent, ZComponent
pt_22 = ConstructPoint(XCoordinate=pdecon_10.XComponent, YCoordinate=pdecon_10.YComponent, ZCoordinate=pdecon_10.ZComponent)
pt_23 = ConstructPoint(XCoordinate=pdecon_11.XComponent, YCoordinate=pdecon_11.YComponent, ZCoordinate=pdecon_11.ZComponent)
clean_25 = CleanTree(RemoveNulls=True, RemoveInvalid=True, RemoveEmpty=False, Tree=sift_9.Output0)
pt_24 = ConstructPoint(XCoordinate=pdecon_12.XComponent, YCoordinate=pdecon_12.YComponent, ZCoordinate=pdecon_12.ZComponent)
clean_26 = CleanTree(RemoveNulls=True, RemoveInvalid=True, RemoveEmpty=False, Tree=sift_9.Output1)
clean_27 = CleanTree(RemoveNulls=True, RemoveInvalid=True, RemoveEmpty=False, Tree=sift_9.Output2)
clean_28 = CleanTree(RemoveNulls=True, RemoveInvalid=True, RemoveEmpty=False, Tree=sift_10.Output0)
clean_29 = CleanTree(RemoveNulls=True, RemoveInvalid=True, RemoveEmpty=False, Tree=sift_10.Output1)
clean_30 = CleanTree(RemoveNulls=True, RemoveInvalid=True, RemoveEmpty=False, Tree=sift_10.Output2)
centroid_2 = Centroid(PointA=pt_16, PointB=pt_18, PointC=pt_17)  # -> Centroid, MedianAB, MedianBC, MedianCA
clean_31 = CleanTree(RemoveNulls=True, RemoveInvalid=True, RemoveEmpty=False, Tree=sift_11.Output0)
clean_32 = CleanTree(RemoveNulls=True, RemoveInvalid=True, RemoveEmpty=False, Tree=sift_11.Output1)
clean_33 = CleanTree(RemoveNulls=True, RemoveInvalid=True, RemoveEmpty=False, Tree=centroid.Centroid)
clean_34 = CleanTree(RemoveNulls=True, RemoveInvalid=True, RemoveEmpty=False, Tree=sift_11.Output2)
centroid_3 = Centroid(PointA=pt_19, PointB=pt_21, PointC=pt_20)  # -> Centroid, MedianAB, MedianBC, MedianCA
pt_25 = ConstructPoint(XCoordinate=pdecon_13.XComponent, YCoordinate=pdecon_13.YComponent, ZCoordinate=pdecon_13.ZComponent)
pt_26 = ConstructPoint(XCoordinate=pdecon_14.XComponent, YCoordinate=pdecon_14.YComponent, ZCoordinate=pdecon_14.ZComponent)
pt_27 = ConstructPoint(XCoordinate=pdecon_15.XComponent, YCoordinate=pdecon_15.YComponent, ZCoordinate=pdecon_15.ZComponent)
pt_28 = ConstructPoint(XCoordinate=pdecon_16.XComponent, YCoordinate=pdecon_16.YComponent, ZCoordinate=pdecon_16.ZComponent)
pt_29 = ConstructPoint(XCoordinate=pdecon_17.XComponent, YCoordinate=pdecon_17.YComponent, ZCoordinate=pdecon_17.ZComponent)
pdecon_19 = Deconstruct(Point=clean_19)  # -> XComponent, YComponent, ZComponent
pdecon_20 = Deconstruct(Point=clean_21)  # -> XComponent, YComponent, ZComponent
pt_30 = ConstructPoint(XCoordinate=pdecon_18.XComponent, YCoordinate=pdecon_18.YComponent, ZCoordinate=pdecon_18.ZComponent)
pdecon_21 = Deconstruct(Point=clean_20)  # -> XComponent, YComponent, ZComponent
clean_35 = CleanTree(RemoveNulls=True, RemoveInvalid=True, RemoveEmpty=False, Tree=sift_12.Output0)
clean_36 = CleanTree(RemoveNulls=True, RemoveInvalid=True, RemoveEmpty=False, Tree=sift_12.Output1)
cp = ClosestPoint(Point=clean_33, Cloud=mcx.Points)  # -> ClosestPoint, CPIndex, Distance
clean_37 = CleanTree(RemoveNulls=True, RemoveInvalid=True, RemoveEmpty=False, Tree=sift_12.Output2)
pdecon_22 = Deconstruct(Point=clean_22)  # -> XComponent, YComponent, ZComponent
pdecon_23 = Deconstruct(Point=clean_24)  # -> XComponent, YComponent, ZComponent
pdecon_24 = Deconstruct(Point=clean_23)  # -> XComponent, YComponent, ZComponent
pdecon_25 = Deconstruct(Point=clean_25)  # -> XComponent, YComponent, ZComponent
pdecon_26 = Deconstruct(Point=clean_27)  # -> XComponent, YComponent, ZComponent
pdecon_27 = Deconstruct(Point=clean_26)  # -> XComponent, YComponent, ZComponent
clean_38 = CleanTree(RemoveNulls=True, RemoveInvalid=True, RemoveEmpty=False, Tree=centroid_2.Centroid)
pdecon_28 = Deconstruct(Point=clean_28)  # -> XComponent, YComponent, ZComponent
pdecon_29 = Deconstruct(Point=clean_30)  # -> XComponent, YComponent, ZComponent
pdecon_30 = Deconstruct(Point=clean_29)  # -> XComponent, YComponent, ZComponent
centroid_4 = Centroid(PointA=pt_22, PointB=pt_24, PointC=pt_23)  # -> Centroid, MedianAB, MedianBC, MedianCA
clean_39 = CleanTree(RemoveNulls=True, RemoveInvalid=True, RemoveEmpty=False, Tree=centroid_3.Centroid)
pt_31 = ConstructPoint(XCoordinate=pdecon_19.XComponent, YCoordinate=pdecon_19.YComponent, ZCoordinate=pdecon_19.ZComponent)
pt_32 = ConstructPoint(XCoordinate=pdecon_20.XComponent, YCoordinate=pdecon_20.YComponent, ZCoordinate=pdecon_20.ZComponent)
pt_33 = ConstructPoint(XCoordinate=pdecon_21.XComponent, YCoordinate=pdecon_21.YComponent, ZCoordinate=pdecon_21.ZComponent)
pdecon_31 = Deconstruct(Point=clean_31)  # -> XComponent, YComponent, ZComponent
pdecon_32 = Deconstruct(Point=clean_34)  # -> XComponent, YComponent, ZComponent
pdecon_33 = Deconstruct(Point=clean_32)  # -> XComponent, YComponent, ZComponent
cp_2 = ClosestPoint(Point=clean_38, Cloud=mcx_2.Points)  # -> ClosestPoint, CPIndex, Distance
pt_34 = ConstructPoint(XCoordinate=pdecon_22.XComponent, YCoordinate=pdecon_22.YComponent, ZCoordinate=pdecon_22.ZComponent)
pt_35 = ConstructPoint(XCoordinate=pdecon_23.XComponent, YCoordinate=pdecon_23.YComponent, ZCoordinate=pdecon_23.ZComponent)
pt_36 = ConstructPoint(XCoordinate=pdecon_24.XComponent, YCoordinate=pdecon_24.YComponent, ZCoordinate=pdecon_24.ZComponent)
cp_3 = ClosestPoint(Point=clean_39, Cloud=mcx_3.Points)  # -> ClosestPoint, CPIndex, Distance
vec2pt = Vector2Pt(PointA=cp.ClosestPoint, PointB=centroid.Centroid, Unitize=False)  # -> Vector, Length
centroid_5 = Centroid(PointA=pt_25, PointB=pt_27, PointC=pt_26)  # -> Centroid, MedianAB, MedianBC, MedianCA
pt_37 = ConstructPoint(XCoordinate=pdecon_25.XComponent, YCoordinate=pdecon_25.YComponent, ZCoordinate=pdecon_25.ZComponent)
pt_38 = ConstructPoint(XCoordinate=pdecon_26.XComponent, YCoordinate=pdecon_26.YComponent, ZCoordinate=pdecon_26.ZComponent)
pdecon_34 = Deconstruct(Point=clean_35)  # -> XComponent, YComponent, ZComponent
pdecon_35 = Deconstruct(Point=clean_37)  # -> XComponent, YComponent, ZComponent
pt_39 = ConstructPoint(XCoordinate=pdecon_27.XComponent, YCoordinate=pdecon_27.YComponent, ZCoordinate=pdecon_27.ZComponent)
pdecon_36 = Deconstruct(Point=clean_36)  # -> XComponent, YComponent, ZComponent
centroid_6 = Centroid(PointA=pt_28, PointB=pt_30, PointC=pt_29)  # -> Centroid, MedianAB, MedianBC, MedianCA
pt_40 = ConstructPoint(XCoordinate=pdecon_28.XComponent, YCoordinate=pdecon_28.YComponent, ZCoordinate=pdecon_28.ZComponent)
pt_41 = ConstructPoint(XCoordinate=pdecon_29.XComponent, YCoordinate=pdecon_29.YComponent, ZCoordinate=pdecon_29.ZComponent)
pt_42 = ConstructPoint(XCoordinate=pdecon_30.XComponent, YCoordinate=pdecon_30.YComponent, ZCoordinate=pdecon_30.ZComponent)
clean_40 = CleanTree(RemoveNulls=True, RemoveInvalid=True, RemoveEmpty=False, Tree=centroid_4.Centroid)
pt_43 = ConstructPoint(XCoordinate=pdecon_31.XComponent, YCoordinate=pdecon_31.YComponent, ZCoordinate=pdecon_31.ZComponent)
pt_44 = ConstructPoint(XCoordinate=pdecon_32.XComponent, YCoordinate=pdecon_32.YComponent, ZCoordinate=pdecon_32.ZComponent)
pt_45 = ConstructPoint(XCoordinate=pdecon_33.XComponent, YCoordinate=pdecon_33.YComponent, ZCoordinate=pdecon_33.ZComponent)
vec2pt_2 = Vector2Pt(PointA=cp_2.ClosestPoint, PointB=centroid_2.Centroid, Unitize=False)  # -> Vector, Length
vdisex = VectorDisplayEx(Point=centroid.Centroid, Vector=vec2pt.Vector, Colour=RGB(0, 0, 0), Width=2)
cp_4 = ClosestPoint(Point=clean_40, Cloud=mcx_4.Points)  # -> ClosestPoint, CPIndex, Distance
pt_46 = ConstructPoint(XCoordinate=pdecon_34.XComponent, YCoordinate=pdecon_34.YComponent, ZCoordinate=pdecon_34.ZComponent)
pt_47 = ConstructPoint(XCoordinate=pdecon_35.XComponent, YCoordinate=pdecon_35.YComponent, ZCoordinate=pdecon_35.ZComponent)
pt_48 = ConstructPoint(XCoordinate=pdecon_36.XComponent, YCoordinate=pdecon_36.YComponent, ZCoordinate=pdecon_36.ZComponent)
vec2pt_3 = Vector2Pt(PointA=cp_3.ClosestPoint, PointB=centroid_3.Centroid, Unitize=False)  # -> Vector, Length
centroid_7 = Centroid(PointA=pt_31, PointB=pt_33, PointC=pt_32)  # -> Centroid, MedianAB, MedianBC, MedianCA
clean_41 = CleanTree(RemoveNulls=True, RemoveInvalid=True, RemoveEmpty=False, Tree=centroid_5.Centroid)
clean_42 = CleanTree(RemoveNulls=True, RemoveInvalid=True, RemoveEmpty=False, Tree=centroid_6.Centroid)
centroid_8 = Centroid(PointA=pt_34, PointB=pt_36, PointC=pt_35)  # -> Centroid, MedianAB, MedianBC, MedianCA
cp_5 = ClosestPoint(Point=clean_41, Cloud=mcx_5.Points)  # -> ClosestPoint, CPIndex, Distance
centroid_9 = Centroid(PointA=pt_37, PointB=pt_39, PointC=pt_38)  # -> Centroid, MedianAB, MedianBC, MedianCA
cp_6 = ClosestPoint(Point=clean_42, Cloud=mcx_6.Points)  # -> ClosestPoint, CPIndex, Distance
centroid_10 = Centroid(PointA=pt_40, PointB=pt_42, PointC=pt_41)  # -> Centroid, MedianAB, MedianBC, MedianCA
vdisex_2 = VectorDisplayEx(Point=centroid_2.Centroid, Vector=vec2pt_2.Vector, Colour=RGB(0, 0, 0), Width=2)
vdisex_3 = VectorDisplayEx(Point=centroid_3.Centroid, Vector=vec2pt_3.Vector, Colour=RGB(0, 0, 0), Width=2)
centroid_11 = Centroid(PointA=pt_43, PointB=pt_45, PointC=pt_44)  # -> Centroid, MedianAB, MedianBC, MedianCA
vec2pt_4 = Vector2Pt(PointA=cp_4.ClosestPoint, PointB=centroid_4.Centroid, Unitize=False)  # -> Vector, Length
clean_43 = CleanTree(RemoveNulls=True, RemoveInvalid=True, RemoveEmpty=False, Tree=centroid_7.Centroid)
clean_44 = CleanTree(RemoveNulls=True, RemoveInvalid=True, RemoveEmpty=False, Tree=centroid_8.Centroid)
centroid_12 = Centroid(PointA=pt_46, PointB=pt_48, PointC=pt_47)  # -> Centroid, MedianAB, MedianBC, MedianCA
cp_7 = ClosestPoint(Point=clean_43, Cloud=mcx_7.Points)  # -> ClosestPoint, CPIndex, Distance
clean_45 = CleanTree(RemoveNulls=True, RemoveInvalid=True, RemoveEmpty=False, Tree=centroid_9.Centroid)
vec2pt_5 = Vector2Pt(PointA=cp_5.ClosestPoint, PointB=centroid_5.Centroid, Unitize=False)  # -> Vector, Length
X_13 = UnitX(Factor=1)
clean_46 = CleanTree(RemoveNulls=True, RemoveInvalid=True, RemoveEmpty=False, Tree=centroid_10.Centroid)
Y_13 = UnitY(Factor=1)
cp_8 = ClosestPoint(Point=clean_44, Cloud=mcx_8.Points)  # -> ClosestPoint, CPIndex, Distance
panel_37 = Panel("IsCone")
panel_38 = Panel("IsDowel")
vec2pt_6 = Vector2Pt(PointA=cp_6.ClosestPoint, PointB=centroid_6.Centroid, Unitize=False)  # -> Vector, Length
panel_39 = Panel("IsPlane")
panel_40 = Panel("IsTenon")
panel_41 = Panel("IsFillet")
panel_42 = Panel("IsBlade")
panel_43 = Panel("IsStrut")
panel_44 = Panel("IsBar")
panel_45 = Panel("IsRidge")
panel_46 = Panel("IsMortise")
panel_47 = Panel("IsHole")
panel_48 = Panel("IsFlange")
vdisex_4 = VectorDisplayEx(Point=centroid_4.Centroid, Vector=vec2pt_4.Vector, Colour=RGB(0, 0, 0), Width=2)
cp_9 = ClosestPoint(Point=clean_45, Cloud=mcx_9.Points)  # -> ClosestPoint, CPIndex, Distance
clean_47 = CleanTree(RemoveNulls=True, RemoveInvalid=True, RemoveEmpty=False, Tree=centroid_11.Centroid)
Z_13 = UnitZ(Factor=1)
cp_10 = ClosestPoint(Point=clean_46, Cloud=mcx_10.Points)  # -> ClosestPoint, CPIndex, Distance
angle = Angle(VectorA=X_13, VectorB=vec2pt.Vector)  # -> Angle, Reflex
angle_2 = Angle(VectorA=Y_13, VectorB=vec2pt.Vector)  # -> Angle, Reflex
cp_11 = ClosestPoint(Point=clean_47, Cloud=mcx_11.Points)  # -> ClosestPoint, CPIndex, Distance
clean_48 = CleanTree(RemoveNulls=True, RemoveInvalid=True, RemoveEmpty=False, Tree=centroid_12.Centroid)
vdisex_5 = VectorDisplayEx(Point=centroid_5.Centroid, Vector=vec2pt_5.Vector, Colour=RGB(0, 0, 0), Width=2)
X_14 = UnitX(Factor=1)
Y_14 = UnitY(Factor=1)
vdisex_6 = VectorDisplayEx(Point=centroid_6.Centroid, Vector=vec2pt_6.Vector, Colour=RGB(0, 0, 0), Width=2)
vec2pt_7 = Vector2Pt(PointA=cp_7.ClosestPoint, PointB=centroid_7.Centroid, Unitize=False)  # -> Vector, Length
X_15 = UnitX(Factor=1)
angle_3 = Angle(VectorA=Z_13, VectorB=vec2pt.Vector)  # -> Angle, Reflex
Y_15 = UnitY(Factor=1)
vec2pt_8 = Vector2Pt(PointA=cp_8.ClosestPoint, PointB=centroid_8.Centroid, Unitize=False)  # -> Vector, Length
Z_14 = UnitZ(Factor=1)
cp_12 = ClosestPoint(Point=clean_48, Cloud=mcx_12.Points)  # -> ClosestPoint, CPIndex, Distance
deg = Degrees(Radians=angle.Angle)
deg_2 = Degrees(Radians=angle_2.Angle)
vlen = VectorLength(Vector=vec2pt.Vector)
Z_15 = UnitZ(Factor=1)
vec2pt_9 = Vector2Pt(PointA=cp_9.ClosestPoint, PointB=centroid_9.Centroid, Unitize=False)  # -> Vector, Length
angle_4 = Angle(VectorA=X_14, VectorB=vec2pt_2.Vector)  # -> Angle, Reflex
angle_5 = Angle(VectorA=Y_14, VectorB=vec2pt_2.Vector)  # -> Angle, Reflex
vec2pt_10 = Vector2Pt(PointA=cp_10.ClosestPoint, PointB=centroid_10.Centroid, Unitize=False)  # -> Vector, Length
angle_6 = Angle(VectorA=X_15, VectorB=vec2pt_3.Vector)  # -> Angle, Reflex
angle_7 = Angle(VectorA=Y_15, VectorB=vec2pt_3.Vector)  # -> Angle, Reflex
deg_3 = Degrees(Radians=angle_3.Reflex)
vdisex_7 = VectorDisplayEx(Point=centroid_7.Centroid, Vector=vec2pt_7.Vector, Colour=RGB(0, 0, 0), Width=2)
vec2pt_11 = Vector2Pt(PointA=cp_11.ClosestPoint, PointB=centroid_11.Centroid, Unitize=False)  # -> Vector, Length
angle_8 = Angle(VectorA=Z_14, VectorB=vec2pt_2.Vector)  # -> Angle, Reflex
X_16 = UnitX(Factor=1)
clean_49 = CleanTree(RemoveNulls=True, RemoveInvalid=True, RemoveEmpty=False, Tree=deg_2)
Y_16 = UnitY(Factor=1)
vdisex_8 = VectorDisplayEx(Point=centroid_8.Centroid, Vector=vec2pt_8.Vector, Colour=RGB(0, 0, 0), Width=2)
angle_9 = Angle(VectorA=Z_15, VectorB=vec2pt_3.Vector)  # -> Angle, Reflex
clean_50 = CleanTree(RemoveNulls=True, RemoveInvalid=True, RemoveEmpty=False, Tree=deg)
deg_4 = Degrees(Radians=angle_4.Angle)
deg_5 = Degrees(Radians=angle_5.Angle)
vlen_2 = VectorLength(Vector=vec2pt_2.Vector)
clean_51 = CleanTree(RemoveNulls=True, RemoveInvalid=True, RemoveEmpty=False, Tree=vlen)
vdisex_9 = VectorDisplayEx(Point=centroid_9.Centroid, Vector=vec2pt_9.Vector, Colour=RGB(0, 0, 0), Width=2)
vec2pt_12 = Vector2Pt(PointA=cp_12.ClosestPoint, PointB=centroid_12.Centroid, Unitize=False)  # -> Vector, Length
Z_16 = UnitZ(Factor=1)
deg_6 = Degrees(Radians=angle_6.Angle)
deg_7 = Degrees(Radians=angle_7.Angle)
vlen_3 = VectorLength(Vector=vec2pt_3.Vector)
vdisex_10 = VectorDisplayEx(Point=centroid_10.Centroid, Vector=vec2pt_10.Vector, Colour=RGB(0, 0, 0), Width=2)
clean_52 = CleanTree(RemoveNulls=True, RemoveInvalid=True, RemoveEmpty=False, Tree=deg_3)
angle_10 = Angle(VectorA=X_16, VectorB=vec2pt_4.Vector)  # -> Angle, Reflex
deg_8 = Degrees(Radians=angle_8.Reflex)
X_17 = UnitX(Factor=1)
angle_11 = Angle(VectorA=Y_16, VectorB=vec2pt_4.Vector)  # -> Angle, Reflex
Y_17 = UnitY(Factor=1)
X_18 = UnitX(Factor=1)
vdisex_11 = VectorDisplayEx(Point=centroid_11.Centroid, Vector=vec2pt_11.Vector, Colour=RGB(0, 0, 0), Width=2)
deg_9 = Degrees(Radians=angle_9.Reflex)
Y_18 = UnitY(Factor=1)
clean_53 = CleanTree(RemoveNulls=True, RemoveInvalid=True, RemoveEmpty=False, Tree=deg_5)
Z_17 = UnitZ(Factor=1)
clean_54 = CleanTree(RemoveNulls=True, RemoveInvalid=True, RemoveEmpty=False, Tree=deg_4)
angle_12 = Angle(VectorA=Z_16, VectorB=vec2pt_4.Vector)  # -> Angle, Reflex
clean_55 = CleanTree(RemoveNulls=True, RemoveInvalid=True, RemoveEmpty=False, Tree=deg_7)
Z_18 = UnitZ(Factor=1)
clean_56 = CleanTree(RemoveNulls=True, RemoveInvalid=True, RemoveEmpty=False, Tree=vlen_2)
clean_57 = CleanTree(RemoveNulls=True, RemoveInvalid=True, RemoveEmpty=False, Tree=deg_6)
vdisex_12 = VectorDisplayEx(Point=centroid_12.Centroid, Vector=vec2pt_12.Vector, Colour=RGB(0, 0, 0), Width=2)
angle_13 = Angle(VectorA=X_17, VectorB=vec2pt_5.Vector)  # -> Angle, Reflex
angle_14 = Angle(VectorA=Y_17, VectorB=vec2pt_5.Vector)  # -> Angle, Reflex
clean_58 = CleanTree(RemoveNulls=True, RemoveInvalid=True, RemoveEmpty=False, Tree=vlen_3)
deg_10 = Degrees(Radians=angle_10.Angle)
deg_11 = Degrees(Radians=angle_11.Angle)
angle_15 = Angle(VectorA=X_18, VectorB=vec2pt_6.Vector)  # -> Angle, Reflex
vlen_4 = VectorLength(Vector=vec2pt_4.Vector)
clean_59 = CleanTree(RemoveNulls=True, RemoveInvalid=True, RemoveEmpty=False, Tree=deg_8)
angle_16 = Angle(VectorA=Y_18, VectorB=vec2pt_6.Vector)  # -> Angle, Reflex
int = Integer(clean_51)
clean_60 = CleanTree(RemoveNulls=True, RemoveInvalid=True, RemoveEmpty=False, Tree=deg_9)
X_19 = UnitX(Factor=1)
angle_17 = Angle(VectorA=Z_17, VectorB=vec2pt_5.Vector)  # -> Angle, Reflex
Y_19 = UnitY(Factor=1)
deg_12 = Degrees(Radians=angle_12.Reflex)
angle_18 = Angle(VectorA=Z_18, VectorB=vec2pt_6.Vector)  # -> Angle, Reflex
X_20 = UnitX(Factor=1)
Y_20 = UnitY(Factor=1)
deg_13 = Degrees(Radians=angle_13.Angle)
deg_14 = Degrees(Radians=angle_14.Angle)
int_2 = Integer(clean_50)
Z_19 = UnitZ(Factor=1)
vlen_5 = VectorLength(Vector=vec2pt_5.Vector)
int_3 = Integer(clean_49)
int_4 = Integer(clean_52)
clean_61 = CleanTree(RemoveNulls=True, RemoveInvalid=True, RemoveEmpty=False, Tree=deg_11)
deg_15 = Degrees(Radians=angle_15.Angle)
deg_16 = Degrees(Radians=angle_16.Angle)
X_21 = UnitX(Factor=1)
vlen_6 = VectorLength(Vector=vec2pt_6.Vector)
clean_62 = CleanTree(RemoveNulls=True, RemoveInvalid=True, RemoveEmpty=False, Tree=deg_10)
Y_21 = UnitY(Factor=1)
Z_20 = UnitZ(Factor=1)
X_22 = UnitX(Factor=1)
angle_19 = Angle(VectorA=X_19, VectorB=vec2pt_7.Vector)  # -> Angle, Reflex
clean_63 = CleanTree(RemoveNulls=True, RemoveInvalid=True, RemoveEmpty=False, Tree=vlen_4)
Y_22 = UnitY(Factor=1)
angle_20 = Angle(VectorA=Y_19, VectorB=vec2pt_7.Vector)  # -> Angle, Reflex
deg_17 = Degrees(Radians=angle_17.Reflex)
int_5 = Integer(clean_56)
angle_21 = Angle(VectorA=X_20, VectorB=vec2pt_8.Vector)  # -> Angle, Reflex
Z_21 = UnitZ(Factor=1)
deg_18 = Degrees(Radians=angle_18.Reflex)
clean_64 = CleanTree(RemoveNulls=True, RemoveInvalid=True, RemoveEmpty=False, Tree=deg_12)
angle_22 = Angle(VectorA=Y_20, VectorB=vec2pt_8.Vector)  # -> Angle, Reflex
X_23 = UnitX(Factor=1)
Z_22 = UnitZ(Factor=1)
Y_23 = UnitY(Factor=1)
int_6 = Integer(clean_58)
clean_65 = CleanTree(RemoveNulls=True, RemoveInvalid=True, RemoveEmpty=False, Tree=deg_14)
angle_23 = Angle(VectorA=Z_19, VectorB=vec2pt_7.Vector)  # -> Angle, Reflex
angle_24 = Angle(VectorA=X_21, VectorB=vec2pt_9.Vector)  # -> Angle, Reflex
clean_66 = CleanTree(RemoveNulls=True, RemoveInvalid=True, RemoveEmpty=False, Tree=deg_13)
angle_25 = Angle(VectorA=Y_21, VectorB=vec2pt_9.Vector)  # -> Angle, Reflex
clean_67 = CleanTree(RemoveNulls=True, RemoveInvalid=True, RemoveEmpty=False, Tree=deg_16)
int_7 = Integer(clean_54)
angle_26 = Angle(VectorA=X_22, VectorB=vec2pt_10.Vector)  # -> Angle, Reflex
int_8 = Integer(clean_53)
clean_68 = CleanTree(RemoveNulls=True, RemoveInvalid=True, RemoveEmpty=False, Tree=vlen_5)
int_9 = Integer(clean_59)
clean_69 = CleanTree(RemoveNulls=True, RemoveInvalid=True, RemoveEmpty=False, Tree=deg_15)
Z_23 = UnitZ(Factor=1)
angle_27 = Angle(VectorA=Z_20, VectorB=vec2pt_8.Vector)  # -> Angle, Reflex
angle_28 = Angle(VectorA=Y_22, VectorB=vec2pt_10.Vector)  # -> Angle, Reflex
deg_19 = Degrees(Radians=angle_19.Angle)
deg_20 = Degrees(Radians=angle_20.Angle)
X_24 = UnitX(Factor=1)
vlen_7 = VectorLength(Vector=vec2pt_7.Vector)
clean_70 = CleanTree(RemoveNulls=True, RemoveInvalid=True, RemoveEmpty=False, Tree=vlen_6)
int_10 = Integer(clean_57)
Y_24 = UnitY(Factor=1)
int_11 = Integer(clean_55)
int_12 = Integer(clean_60)
clean_71 = CleanTree(RemoveNulls=True, RemoveInvalid=True, RemoveEmpty=False, Tree=deg_17)
angle_29 = Angle(VectorA=X_23, VectorB=vec2pt_11.Vector)  # -> Angle, Reflex
deg_21 = Degrees(Radians=angle_21.Angle)
deg_22 = Degrees(Radians=angle_22.Angle)
angle_30 = Angle(VectorA=Z_21, VectorB=vec2pt_9.Vector)  # -> Angle, Reflex
vlen_8 = VectorLength(Vector=vec2pt_8.Vector)
angle_31 = Angle(VectorA=Y_23, VectorB=vec2pt_11.Vector)  # -> Angle, Reflex
clean_72 = CleanTree(RemoveNulls=True, RemoveInvalid=True, RemoveEmpty=False, Tree=deg_18)
angle_32 = Angle(VectorA=Z_22, VectorB=vec2pt_10.Vector)  # -> Angle, Reflex
Z_24 = UnitZ(Factor=1)
deg_23 = Degrees(Radians=angle_23.Reflex)
deg_24 = Degrees(Radians=angle_24.Angle)
deg_25 = Degrees(Radians=angle_25.Angle)
vlen_9 = VectorLength(Vector=vec2pt_9.Vector)
int_13 = Integer(clean_63)
deg_26 = Degrees(Radians=angle_26.Angle)
deg_27 = Degrees(Radians=angle_28.Angle)
deg_28 = Degrees(Radians=angle_27.Reflex)
angle_33 = Angle(VectorA=X_24, VectorB=vec2pt_12.Vector)  # -> Angle, Reflex
angle_34 = Angle(VectorA=Z_23, VectorB=vec2pt_11.Vector)  # -> Angle, Reflex
vlen_10 = VectorLength(Vector=vec2pt_10.Vector)
clean_73 = CleanTree(RemoveNulls=True, RemoveInvalid=True, RemoveEmpty=False, Tree=deg_20)
angle_35 = Angle(VectorA=Y_24, VectorB=vec2pt_12.Vector)  # -> Angle, Reflex
clean_74 = CleanTree(RemoveNulls=True, RemoveInvalid=True, RemoveEmpty=False, Tree=deg_19)
deg_29 = Degrees(Radians=angle_30.Reflex)
deg_30 = Degrees(Radians=angle_29.Angle)
deg_31 = Degrees(Radians=angle_31.Angle)
clean_75 = CleanTree(RemoveNulls=True, RemoveInvalid=True, RemoveEmpty=False, Tree=vlen_7)
clean_76 = CleanTree(RemoveNulls=True, RemoveInvalid=True, RemoveEmpty=False, Tree=deg_22)
vlen_11 = VectorLength(Vector=vec2pt_11.Vector)
int_14 = Integer(clean_62)
clean_77 = CleanTree(RemoveNulls=True, RemoveInvalid=True, RemoveEmpty=False, Tree=deg_21)
deg_32 = Degrees(Radians=angle_32.Reflex)
int_15 = Integer(clean_61)
int_16 = Integer(clean_64)
angle_36 = Angle(VectorA=Z_24, VectorB=vec2pt_12.Vector)  # -> Angle, Reflex
clean_78 = CleanTree(RemoveNulls=True, RemoveInvalid=True, RemoveEmpty=False, Tree=vlen_8)
clean_79 = CleanTree(RemoveNulls=True, RemoveInvalid=True, RemoveEmpty=False, Tree=deg_23)
clean_80 = CleanTree(RemoveNulls=True, RemoveInvalid=True, RemoveEmpty=False, Tree=deg_25)
int_17 = Integer(clean_68)
clean_81 = CleanTree(RemoveNulls=True, RemoveInvalid=True, RemoveEmpty=False, Tree=deg_24)
deg_33 = Degrees(Radians=angle_34.Reflex)
clean_82 = CleanTree(RemoveNulls=True, RemoveInvalid=True, RemoveEmpty=False, Tree=deg_27)
int_18 = Integer(clean_70)
deg_34 = Degrees(Radians=angle_33.Angle)
deg_35 = Degrees(Radians=angle_35.Angle)
clean_83 = CleanTree(RemoveNulls=True, RemoveInvalid=True, RemoveEmpty=False, Tree=deg_28)
clean_84 = CleanTree(RemoveNulls=True, RemoveInvalid=True, RemoveEmpty=False, Tree=vlen_9)
vlen_12 = VectorLength(Vector=vec2pt_12.Vector)
clean_85 = CleanTree(RemoveNulls=True, RemoveInvalid=True, RemoveEmpty=False, Tree=deg_26)
clean_86 = CleanTree(RemoveNulls=True, RemoveInvalid=True, RemoveEmpty=False, Tree=vlen_10)
clean_87 = CleanTree(RemoveNulls=True, RemoveInvalid=True, RemoveEmpty=False, Tree=deg_31)
int_19 = Integer(clean_66)
int_20 = Integer(clean_65)
int_21 = Integer(clean_71)
clean_88 = CleanTree(RemoveNulls=True, RemoveInvalid=True, RemoveEmpty=False, Tree=deg_29)
clean_89 = CleanTree(RemoveNulls=True, RemoveInvalid=True, RemoveEmpty=False, Tree=deg_30)
int_22 = Integer(clean_69)
deg_36 = Degrees(Radians=angle_36.Reflex)
int_23 = Integer(clean_67)
int_24 = Integer(clean_72)
clean_90 = CleanTree(RemoveNulls=True, RemoveInvalid=True, RemoveEmpty=False, Tree=deg_32)
clean_91 = CleanTree(RemoveNulls=True, RemoveInvalid=True, RemoveEmpty=False, Tree=vlen_11)
clean_92 = CleanTree(RemoveNulls=True, RemoveInvalid=True, RemoveEmpty=False, Tree=deg_35)
clean_93 = CleanTree(RemoveNulls=True, RemoveInvalid=True, RemoveEmpty=False, Tree=deg_33)
clean_94 = CleanTree(RemoveNulls=True, RemoveInvalid=True, RemoveEmpty=False, Tree=deg_34)
int_25 = Integer(clean_75)
clean_95 = CleanTree(RemoveNulls=True, RemoveInvalid=True, RemoveEmpty=False, Tree=vlen_12)
int_26 = Integer(clean_78)
clean_96 = CleanTree(RemoveNulls=True, RemoveInvalid=True, RemoveEmpty=False, Tree=deg_36)
int_27 = Integer(clean_74)
int_28 = Integer(clean_73)
int_29 = Integer(clean_79)
int_30 = Integer(clean_84)
int_31 = Integer(clean_77)
int_32 = Integer(clean_86)
int_33 = Integer(clean_76)
int_34 = Integer(clean_83)
int_35 = Integer(clean_81)
int_36 = Integer(clean_91)
int_37 = Integer(clean_80)
int_38 = Integer(clean_88)
int_39 = Integer(clean_85)
int_40 = Integer(clean_82)
int_41 = Integer(clean_90)
int_42 = Integer(clean_89)
int_43 = Integer(clean_87)
int_44 = Integer(clean_93)
int_45 = Integer(clean_95)
concat = Concatenate(
    FragmentA=int,
    FragmentB=",",
    FragmentC=int_2,
    FragmentD=",",
    FragmentE=int_3,
    FragmentF=",",
    FragmentG=int_4,
    FragmentH=",",
    FragmentI="0",
    FragmentJ=",",
    FragmentK="0",
    FragmentL=",",
    FragmentM="0",
    FragmentN=",",
    FragmentO="1",
    FragmentP=",",
    FragmentQ="0",
    FragmentR=",",
    FragmentS="0",
    FragmentT=",",
    FragmentU="0",
    FragmentV=",",
    FragmentW="0",
    FragmentX=",",
    FragmentY="0",
    FragmentZ=",",
    FragmentAA="0",
    FragmentAB=",",
    FragmentAC="0",
    FragmentAD=",",
    FragmentAE="0")
int_46 = Integer(clean_94)
int_47 = Integer(clean_92)
int_48 = Integer(clean_96)
concat_2 = Concatenate(
    FragmentA=int_5,
    FragmentB=",",
    FragmentC=int_7,
    FragmentD=",",
    FragmentE=int_8,
    FragmentF=",",
    FragmentG=int_9,
    FragmentH=",",
    FragmentI="0",
    FragmentJ=",",
    FragmentK="0",
    FragmentL=",",
    FragmentM="0",
    FragmentN=",",
    FragmentO="0",
    FragmentP=",",
    FragmentQ="1",
    FragmentR=",",
    FragmentS="0",
    FragmentT=",",
    FragmentU="0",
    FragmentV=",",
    FragmentW="0",
    FragmentX=",",
    FragmentY="0",
    FragmentZ=",",
    FragmentAA="0",
    FragmentAB=",",
    FragmentAC="0",
    FragmentAD=",",
    FragmentAE="0")
concat_3 = Concatenate(
    FragmentA=int_6,
    FragmentB=",",
    FragmentC=int_10,
    FragmentD=",",
    FragmentE=int_11,
    FragmentF=",",
    FragmentG=int_12,
    FragmentH=",",
    FragmentI="0",
    FragmentJ=",",
    FragmentK="0",
    FragmentL=",",
    FragmentM="1",
    FragmentN=",",
    FragmentO="0",
    FragmentP=",",
    FragmentQ="0",
    FragmentR=",",
    FragmentS="0",
    FragmentT=",",
    FragmentU="0",
    FragmentV=",",
    FragmentW="0",
    FragmentX=",",
    FragmentY="0",
    FragmentZ=",",
    FragmentAA="0",
    FragmentAB=",",
    FragmentAC="0",
    FragmentAD=",",
    FragmentAE="0")
concat_4 = Concatenate(
    FragmentA=int_13,
    FragmentB=",",
    FragmentC=int_14,
    FragmentD=",",
    FragmentE=int_15,
    FragmentF=",",
    FragmentG=int_16,
    FragmentH=",",
    FragmentI="0",
    FragmentJ=",",
    FragmentK="1",
    FragmentL=",",
    FragmentM="0",
    FragmentN=",",
    FragmentO="0",
    FragmentP=",",
    FragmentQ="0",
    FragmentR=",",
    FragmentS="0",
    FragmentT=",",
    FragmentU="0",
    FragmentV=",",
    FragmentW="0",
    FragmentX=",",
    FragmentY="0",
    FragmentZ=",",
    FragmentAA="0",
    FragmentAB=",",
    FragmentAC="0",
    FragmentAD=",",
    FragmentAE="0")
concat_5 = Concatenate(
    FragmentA=int_17,
    FragmentB=",",
    FragmentC=int_19,
    FragmentD=",",
    FragmentE=int_20,
    FragmentF=",",
    FragmentG=int_21,
    FragmentH=",",
    FragmentI="0",
    FragmentJ=",",
    FragmentK="0",
    FragmentL=",",
    FragmentM="0",
    FragmentN=",",
    FragmentO="0",
    FragmentP=",",
    FragmentQ="0",
    FragmentR=",",
    FragmentS="1",
    FragmentT=",",
    FragmentU="0",
    FragmentV=",",
    FragmentW="0",
    FragmentX=",",
    FragmentY="0",
    FragmentZ=",",
    FragmentAA="0",
    FragmentAB=",",
    FragmentAC="0",
    FragmentAD=",",
    FragmentAE="0")
concat_6 = Concatenate(
    FragmentA=int_18,
    FragmentB=",",
    FragmentC=int_22,
    FragmentD=",",
    FragmentE=int_23,
    FragmentF=",",
    FragmentG=int_24,
    FragmentH=",",
    FragmentI="1",
    FragmentJ=",",
    FragmentK="0",
    FragmentL=",",
    FragmentM="0",
    FragmentN=",",
    FragmentO="0",
    FragmentP=",",
    FragmentQ="0",
    FragmentR=",",
    FragmentS="0",
    FragmentT=",",
    FragmentU="0",
    FragmentV=",",
    FragmentW="0",
    FragmentX=",",
    FragmentY="0",
    FragmentZ=",",
    FragmentAA="0",
    FragmentAB=",",
    FragmentAC="0",
    FragmentAD=",",
    FragmentAE="0")
concat_7 = Concatenate(
    FragmentA=int_25,
    FragmentB=",",
    FragmentC=int_27,
    FragmentD=",",
    FragmentE=int_28,
    FragmentF=",",
    FragmentG=int_29,
    FragmentH=",",
    FragmentI="0",
    FragmentJ=",",
    FragmentK="0",
    FragmentL=",",
    FragmentM="0",
    FragmentN=",",
    FragmentO="0",
    FragmentP=",",
    FragmentQ="0",
    FragmentR=",",
    FragmentS="0",
    FragmentT=",",
    FragmentU="0",
    FragmentV=",",
    FragmentW="0",
    FragmentX=",",
    FragmentY="0",
    FragmentZ=",",
    FragmentAA="0",
    FragmentAB=",",
    FragmentAC="1",
    FragmentAD=",",
    FragmentAE="0")
concat_8 = Concatenate(
    FragmentA=int_26,
    FragmentB=",",
    FragmentC=int_31,
    FragmentD=",",
    FragmentE=int_33,
    FragmentF=",",
    FragmentG=int_34,
    FragmentH=",",
    FragmentI="0",
    FragmentJ=",",
    FragmentK="0",
    FragmentL=",",
    FragmentM="0",
    FragmentN=",",
    FragmentO="0",
    FragmentP=",",
    FragmentQ="0",
    FragmentR=",",
    FragmentS="0",
    FragmentT=",",
    FragmentU="1",
    FragmentV=",",
    FragmentW="0",
    FragmentX=",",
    FragmentY="0",
    FragmentZ=",",
    FragmentAA="0",
    FragmentAB=",",
    FragmentAC="0",
    FragmentAD=",",
    FragmentAE="0")
concat_9 = Concatenate(
    FragmentA=int_30,
    FragmentB=",",
    FragmentC=int_35,
    FragmentD=",",
    FragmentE=int_37,
    FragmentF=",",
    FragmentG=int_38,
    FragmentH=",",
    FragmentI="0",
    FragmentJ=",",
    FragmentK="0",
    FragmentL=",",
    FragmentM="0",
    FragmentN=",",
    FragmentO="0",
    FragmentP=",",
    FragmentQ="0",
    FragmentR=",",
    FragmentS="0",
    FragmentT=",",
    FragmentU="0",
    FragmentV=",",
    FragmentW="1",
    FragmentX=",",
    FragmentY="0",
    FragmentZ=",",
    FragmentAA="0",
    FragmentAB=",",
    FragmentAC="0",
    FragmentAD=",",
    FragmentAE="0")
concat_10 = Concatenate(
    FragmentA=int_32,
    FragmentB=",",
    FragmentC=int_39,
    FragmentD=",",
    FragmentE=int_40,
    FragmentF=",",
    FragmentG=int_41,
    FragmentH=",",
    FragmentI="0",
    FragmentJ=",",
    FragmentK="0",
    FragmentL=",",
    FragmentM="0",
    FragmentN=",",
    FragmentO="0",
    FragmentP=",",
    FragmentQ="0",
    FragmentR=",",
    FragmentS="0",
    FragmentT=",",
    FragmentU="0",
    FragmentV=",",
    FragmentW="0",
    FragmentX=",",
    FragmentY="0",
    FragmentZ=",",
    FragmentAA="1",
    FragmentAB=",",
    FragmentAC="0",
    FragmentAD=",",
    FragmentAE="0")
concat_11 = Concatenate(
    FragmentA=int_36,
    FragmentB=",",
    FragmentC=int_42,
    FragmentD=",",
    FragmentE=int_43,
    FragmentF=",",
    FragmentG=int_44,
    FragmentH=",",
    FragmentI="0",
    FragmentJ=",",
    FragmentK="0",
    FragmentL=",",
    FragmentM="0",
    FragmentN=",",
    FragmentO="0",
    FragmentP=",",
    FragmentQ="0",
    FragmentR=",",
    FragmentS="0",
    FragmentT=",",
    FragmentU="0",
    FragmentV=",",
    FragmentW="0",
    FragmentX=",",
    FragmentY="1",
    FragmentZ=",",
    FragmentAA="0",
    FragmentAB=",",
    FragmentAC="0",
    FragmentAD=",",
    FragmentAE="0")
concat_12 = Concatenate(
    FragmentA=int_45,
    FragmentB=",",
    FragmentC=int_46,
    FragmentD=",",
    FragmentE=int_47,
    FragmentF=",",
    FragmentG=int_48,
    FragmentH=",",
    FragmentI="0",
    FragmentJ=",",
    FragmentK="0",
    FragmentL=",",
    FragmentM="0",
    FragmentN=",",
    FragmentO="0",
    FragmentP=",",
    FragmentQ="0",
    FragmentR=",",
    FragmentS="0",
    FragmentT=",",
    FragmentU="0",
    FragmentV=",",
    FragmentW="0",
    FragmentX=",",
    FragmentY="0",
    FragmentZ=",",
    FragmentAA="0",
    FragmentAB=",",
    FragmentAC="0",
    FragmentAD=",",
    FragmentAE="1")
concat_13 = Concatenate(
    FragmentA="Vlen",
    FragmentB=",",
    FragmentC="VdegX",
    FragmentD=",",
    FragmentE="VdegY",
    FragmentF=",",
    FragmentG="VdegZ",
    FragmentH=",",
    FragmentI="IsHole",
    FragmentJ=",",
    FragmentK="IsFlange",
    FragmentL=",",
    FragmentM="IsRidge",
    FragmentN=",",
    FragmentO="IsMortise",
    FragmentP=",",
    FragmentQ="IsTenon",
    FragmentR=",",
    FragmentS="IsPlane",
    FragmentT=",",
    FragmentU="IsFillet",
    FragmentV=",",
    FragmentW="IsStrut",
    FragmentX=",",
    FragmentY="IsCone",
    FragmentZ=",",
    FragmentAA="IsBlade",
    FragmentAB=",",
    FragmentAC="IsDowel",
    FragmentAD=",",
    FragmentAE="IsBar")
concat_14 = Concatenate(
    FragmentA="Vlen",
    FragmentB=",",
    FragmentC="VdegX",
    FragmentD=",",
    FragmentE="VdegY",
    FragmentF=",",
    FragmentG="VdegZ",
    FragmentH=",",
    FragmentI="IsHole",
    FragmentJ=",",
    FragmentK="IsFlange",
    FragmentL=",",
    FragmentM="IsRidge",
    FragmentN=",",
    FragmentO="IsMortise",
    FragmentP=",",
    FragmentQ="IsTenon",
    FragmentR=",",
    FragmentS="IsPlane",
    FragmentT=",",
    FragmentU="IsFillet",
    FragmentV=",",
    FragmentW="IsStrut",
    FragmentX=",",
    FragmentY="IsCone",
    FragmentZ=",",
    FragmentAA="IsBlade",
    FragmentAB=",",
    FragmentAC="IsDowel",
    FragmentAD=",",
    FragmentAE="IsBar")
concat_15 = Concatenate(
    FragmentA="Vlen",
    FragmentB=",",
    FragmentC="VdegX",
    FragmentD=",",
    FragmentE="VdegY",
    FragmentF=",",
    FragmentG="VdegZ",
    FragmentH=",",
    FragmentI="IsHole",
    FragmentJ=",",
    FragmentK="IsFlange",
    FragmentL=",",
    FragmentM="IsRidge",
    FragmentN=",",
    FragmentO="IsMortise",
    FragmentP=",",
    FragmentQ="IsTenon",
    FragmentR=",",
    FragmentS="IsPlane",
    FragmentT=",",
    FragmentU="IsFillet",
    FragmentV=",",
    FragmentW="IsStrut",
    FragmentX=",",
    FragmentY="IsCone",
    FragmentZ=",",
    FragmentAA="IsBlade",
    FragmentAB=",",
    FragmentAC="IsDowel",
    FragmentAD=",",
    FragmentAE="IsBar")
concat_16 = Concatenate(
    FragmentA="Vlen",
    FragmentB=",",
    FragmentC="VdegX",
    FragmentD=",",
    FragmentE="VdegY",
    FragmentF=",",
    FragmentG="VdegZ",
    FragmentH=",",
    FragmentI="IsHole",
    FragmentJ=",",
    FragmentK="IsFlange",
    FragmentL=",",
    FragmentM="IsRidge",
    FragmentN=",",
    FragmentO="IsMortise",
    FragmentP=",",
    FragmentQ="IsTenon",
    FragmentR=",",
    FragmentS="IsPlane",
    FragmentT=",",
    FragmentU="IsFillet",
    FragmentV=",",
    FragmentW="IsStrut",
    FragmentX=",",
    FragmentY="IsCone",
    FragmentZ=",",
    FragmentAA="IsBlade",
    FragmentAB=",",
    FragmentAC="IsDowel",
    FragmentAD=",",
    FragmentAE="IsBar")
concat_17 = Concatenate(
    FragmentA="Vlen",
    FragmentB=",",
    FragmentC="VdegX",
    FragmentD=",",
    FragmentE="VdegY",
    FragmentF=",",
    FragmentG="VdegZ",
    FragmentH=",",
    FragmentI="IsHole",
    FragmentJ=",",
    FragmentK="IsFlange",
    FragmentL=",",
    FragmentM="IsRidge",
    FragmentN=",",
    FragmentO="IsMortise",
    FragmentP=",",
    FragmentQ="IsTenon",
    FragmentR=",",
    FragmentS="IsPlane",
    FragmentT=",",
    FragmentU="IsFillet",
    FragmentV=",",
    FragmentW="IsStrut",
    FragmentX=",",
    FragmentY="IsCone",
    FragmentZ=",",
    FragmentAA="IsBlade",
    FragmentAB=",",
    FragmentAC="IsDowel",
    FragmentAD=",",
    FragmentAE="IsBar")
concat_18 = Concatenate(
    FragmentA="Vlen",
    FragmentB=",",
    FragmentC="VdegX",
    FragmentD=",",
    FragmentE="VdegY",
    FragmentF=",",
    FragmentG="VdegZ",
    FragmentH=",",
    FragmentI="IsHole",
    FragmentJ=",",
    FragmentK="IsFlange",
    FragmentL=",",
    FragmentM="IsRidge",
    FragmentN=",",
    FragmentO="IsMortise",
    FragmentP=",",
    FragmentQ="IsTenon",
    FragmentR=",",
    FragmentS="IsPlane",
    FragmentT=",",
    FragmentU="IsFillet",
    FragmentV=",",
    FragmentW="IsStrut",
    FragmentX=",",
    FragmentY="IsCone",
    FragmentZ=",",
    FragmentAA="IsBlade",
    FragmentAB=",",
    FragmentAC="IsDowel",
    FragmentAD=",",
    FragmentAE="IsBar")
concat_19 = Concatenate(
    FragmentA="Vlen",
    FragmentB=",",
    FragmentC="VdegX",
    FragmentD=",",
    FragmentE="VdegY",
    FragmentF=",",
    FragmentG="VdegZ",
    FragmentH=",",
    FragmentI="IsHole",
    FragmentJ=",",
    FragmentK="IsFlange",
    FragmentL=",",
    FragmentM="IsRidge",
    FragmentN=",",
    FragmentO="IsMortise",
    FragmentP=",",
    FragmentQ="IsTenon",
    FragmentR=",",
    FragmentS="IsPlane",
    FragmentT=",",
    FragmentU="IsFillet",
    FragmentV=",",
    FragmentW="IsStrut",
    FragmentX=",",
    FragmentY="IsCone",
    FragmentZ=",",
    FragmentAA="IsBlade",
    FragmentAB=",",
    FragmentAC="IsDowel",
    FragmentAD=",",
    FragmentAE="IsBar")
concat_20 = Concatenate(
    FragmentA="Vlen",
    FragmentB=",",
    FragmentC="VdegX",
    FragmentD=",",
    FragmentE="VdegY",
    FragmentF=",",
    FragmentG="VdegZ",
    FragmentH=",",
    FragmentI="IsHole",
    FragmentJ=",",
    FragmentK="IsFlange",
    FragmentL=",",
    FragmentM="IsRidge",
    FragmentN=",",
    FragmentO="IsMortise",
    FragmentP=",",
    FragmentQ="IsTenon",
    FragmentR=",",
    FragmentS="IsPlane",
    FragmentT=",",
    FragmentU="IsFillet",
    FragmentV=",",
    FragmentW="IsStrut",
    FragmentX=",",
    FragmentY="IsCone",
    FragmentZ=",",
    FragmentAA="IsBlade",
    FragmentAB=",",
    FragmentAC="IsDowel",
    FragmentAD=",",
    FragmentAE="IsBar")
concat_21 = Concatenate(
    FragmentA="Vlen",
    FragmentB=",",
    FragmentC="VdegX",
    FragmentD=",",
    FragmentE="VdegY",
    FragmentF=",",
    FragmentG="VdegZ",
    FragmentH=",",
    FragmentI="IsHole",
    FragmentJ=",",
    FragmentK="IsFlange",
    FragmentL=",",
    FragmentM="IsRidge",
    FragmentN=",",
    FragmentO="IsMortise",
    FragmentP=",",
    FragmentQ="IsTenon",
    FragmentR=",",
    FragmentS="IsPlane",
    FragmentT=",",
    FragmentU="IsFillet",
    FragmentV=",",
    FragmentW="IsStrut",
    FragmentX=",",
    FragmentY="IsCone",
    FragmentZ=",",
    FragmentAA="IsBlade",
    FragmentAB=",",
    FragmentAC="IsDowel",
    FragmentAD=",",
    FragmentAE="IsBar")
concat_22 = Concatenate(
    FragmentA="Vlen",
    FragmentB=",",
    FragmentC="VdegX",
    FragmentD=",",
    FragmentE="VdegY",
    FragmentF=",",
    FragmentG="VdegZ",
    FragmentH=",",
    FragmentI="IsHole",
    FragmentJ=",",
    FragmentK="IsFlange",
    FragmentL=",",
    FragmentM="IsRidge",
    FragmentN=",",
    FragmentO="IsMortise",
    FragmentP=",",
    FragmentQ="IsTenon",
    FragmentR=",",
    FragmentS="IsPlane",
    FragmentT=",",
    FragmentU="IsFillet",
    FragmentV=",",
    FragmentW="IsStrut",
    FragmentX=",",
    FragmentY="IsCone",
    FragmentZ=",",
    FragmentAA="IsBlade",
    FragmentAB=",",
    FragmentAC="IsDowel",
    FragmentAD=",",
    FragmentAE="IsBar")
concat_23 = Concatenate(
    FragmentA="Vlen",
    FragmentB=",",
    FragmentC="VdegX",
    FragmentD=",",
    FragmentE="VdegY",
    FragmentF=",",
    FragmentG="VdegZ",
    FragmentH=",",
    FragmentI="IsHole",
    FragmentJ=",",
    FragmentK="IsFlange",
    FragmentL=",",
    FragmentM="IsRidge",
    FragmentN=",",
    FragmentO="IsMortise",
    FragmentP=",",
    FragmentQ="IsTenon",
    FragmentR=",",
    FragmentS="IsPlane",
    FragmentT=",",
    FragmentU="IsFillet",
    FragmentV=",",
    FragmentW="IsStrut",
    FragmentX=",",
    FragmentY="IsCone",
    FragmentZ=",",
    FragmentAA="IsBlade",
    FragmentAB=",",
    FragmentAC="IsDowel",
    FragmentAD=",",
    FragmentAE="IsBar")
concat_24 = Concatenate(
    FragmentA="Vlen",
    FragmentB=",",
    FragmentC="VdegX",
    FragmentD=",",
    FragmentE="VdegY",
    FragmentF=",",
    FragmentG="VdegZ",
    FragmentH=",",
    FragmentI="IsHole",
    FragmentJ=",",
    FragmentK="IsFlange",
    FragmentL=",",
    FragmentM="IsRidge",
    FragmentN=",",
    FragmentO="IsMortise",
    FragmentP=",",
    FragmentQ="IsTenon",
    FragmentR=",",
    FragmentS="IsPlane",
    FragmentT=",",
    FragmentU="IsFillet",
    FragmentV=",",
    FragmentW="IsStrut",
    FragmentX=",",
    FragmentY="IsCone",
    FragmentZ=",",
    FragmentAA="IsBlade",
    FragmentAB=",",
    FragmentAC="IsDowel",
    FragmentAD=",",
    FragmentAE="IsBar")
merge = Merge(Data1=concat_13, Data2=concat)  # -> flatten(Result)
merge_2 = Merge(Data1=concat_14, Data2=concat_2)  # -> flatten(Result)
merge_3 = Merge(Data1=concat_15, Data2=concat_3)  # -> flatten(Result)
panel_181 = Panel(merge)
merge_4 = Merge(Data1=concat_16, Data2=concat_4)  # -> flatten(Result)
panel_182 = Panel(merge_2)
panel_183 = Panel(merge_3)
merge_5 = Merge(Data1=concat_17, Data2=concat_5)  # -> flatten(Result)
merge_6 = Merge(Data1=concat_18, Data2=concat_6)  # -> flatten(Result)
panel_184 = Panel(merge_4)
merge_7 = Merge(Data1=concat_19, Data2=concat_7)  # -> flatten(Result)
panel_185 = Panel(merge_5)
merge_8 = Merge(Data1=concat_20, Data2=concat_8)  # -> flatten(Result)
panel_186 = Panel(merge_6)
merge_9 = Merge(Data1=concat_21, Data2=concat_9)  # -> flatten(Result)
merge_10 = Merge(Data1=concat_22, Data2=concat_10)  # -> flatten(Result)
merge_11 = Merge(Data1=concat_23, Data2=concat_11)  # -> flatten(Result)
panel_187 = Panel(merge_7)
panel_188 = Panel(merge_8)
merge_12 = Merge(Data1=concat_24, Data2=concat_12)  # -> flatten(Result)
panel_189 = Panel(merge_9)
panel_190 = Panel(merge_10)
panel_191 = Panel(merge_11)
panel_192 = Panel("C:\Users\KarlRoesch\Desktop\karldesktopfolder\bracket\trainform\mortise\mortise.csv")
panel_193 = Panel(merge_12)
panel_194 = Panel("C:\Users\KarlRoesch\Desktop\karldesktopfolder\bracket\trainform\tenon\tenon.csv")
panel_195 = Panel("C:\Users\KarlRoesch\Desktop\karldesktopfolder\bracket\trainform\ridge\ridge.csv")
panel_196 = Panel("C:\Users\KarlRoesch\Desktop\karldesktopfolder\bracket\trainform\hole\hole.csv")
panel_197 = Panel("C:\Users\KarlRoesch\Desktop\karldesktopfolder\bracket\trainform\plane\plane.csv")
panel_198 = Panel("C:\Users\KarlRoesch\Desktop\karldesktopfolder\bracket\trainform\flange\flange.csv")
panel_199 = Panel("C:\Users\KarlRoesch\Desktop\karldesktopfolder\bracket\trainform\dowel\dowel.csv")
panel_200 = Panel("C:\Users\KarlRoesch\Desktop\karldesktopfolder\bracket\trainform\fillet\fillet.csv")
panel_201 = Panel("C:\Users\KarlRoesch\Desktop\karldesktopfolder\bracket\trainform\strut\strut.csv")
panel_202 = Panel("C:\Users\KarlRoesch\Desktop\karldesktopfolder\bracket\trainform\blade\blade.csv")
panel_203 = Panel("C:\Users\KarlRoesch\Desktop\karldesktopfolder\bracket\trainform\cone\cone.csv")
button_2 = Button()
panel_204 = Panel("C:\Users\KarlRoesch\Desktop\karldesktopfolder\bracket\trainform\bar\bar.csv")
path = FilePath(panel_192)
button_3 = Button()
button_4 = Button()
c_script = CSharpScript(save=button, path=path, data=panel_181)  # inputs save: Boolean, path: String, data: list of String
# ---------- c_script: C# ----------
    if(save){
      var fileinfo = new System.IO.FileInfo(path);
      if(!fileinfo.Directory.Exists){
        fileinfo.Directory.Create();
      }
      
      var sw = fileinfo.CreateText();
      for(int i = 0; i < data.Count; i++){
        string row = data[i];
        if(i < data.Count - 1){
          sw.WriteLine(row);
        }else{
          sw.Write(row);
        }
      }
      
      sw.Flush();
      sw.Close();
    }
# ---------- end c_script ----------
path_2 = FilePath(panel_194)
path_3 = FilePath(panel_195)
button_5 = Button()
c_script_2 = CSharpScript(save=button, path=path_2, data=panel_182)  # inputs save: Boolean, path: String, data: list of String; same code as c_script
c_script_3 = CSharpScript(save=button, path=path_3, data=panel_183)  # inputs save: Boolean, path: String, data: list of String; same code as c_script
path_4 = FilePath(panel_198)
button_6 = Button()
path_5 = FilePath(panel_197)
path_6 = FilePath(panel_196)
c_script_4 = CSharpScript(save=button, path=path_4, data=panel_184)  # inputs save: Boolean, path: String, data: list of String; same code as c_script
button_7 = Button()
button_8 = Button()
c_script_5 = CSharpScript(save=button, path=path_5, data=panel_185)  # inputs save: Boolean, path: String, data: list of String; same code as c_script
c_script_6 = CSharpScript(save=button, path=path_6, data=panel_186)  # inputs save: Boolean, path: String, data: list of String; same code as c_script
button_9 = Button()
path_7 = FilePath(panel_199)
button_10 = Button()
path_8 = FilePath(panel_200)
button_11 = Button()
path_9 = FilePath(panel_201)
path_10 = FilePath(panel_202)
c_script_7 = CSharpScript(save=button, path=path_7, data=panel_187)  # inputs save: Boolean, path: String, data: list of String; same code as c_script
button_12 = Button()
path_11 = FilePath(panel_203)
c_script_8 = CSharpScript(save=button, path=path_8, data=panel_188)  # inputs save: Boolean, path: String, data: list of String; same code as c_script
c_script_9 = CSharpScript(save=button, path=path_9, data=panel_189)  # inputs save: Boolean, path: String, data: list of String; same code as c_script
path_12 = FilePath(panel_204)
c_script_10 = CSharpScript(save=button, path=path_10, data=panel_190)  # inputs save: Boolean, path: String, data: list of String; same code as c_script
c_script_11 = CSharpScript(save=button, path=path_11, data=panel_191)  # inputs save: Boolean, path: String, data: list of String; same code as c_script
c_script_12 = CSharpScript(save=button, path=path_12, data=panel_193)  # inputs save: Boolean, path: String, data: list of String; same code as c_script
